# Grasshopper definition sound-vase.gh (Grasshopper 1.0.7)
# plug-ins: Pufferfish, MosquitoAudio2, EdiTree

# ---- group: soundscape
# mosquito plugin
toggle = BooleanToggle(False)
skip = Slider(500, range=0..5000)
divisions = Slider(12, range=0..36)
x_offset = Slider(0.5, range=0..1)
stop = Slider(250, range=0..10000)
start = Slider(0, range=0..10000)
z_factor = Slider(3, range=0..12)
# audio waveform
path = FilePath("D:\rhino\grasshopper\Neon Drip.mp3")
y_factor = Slider(1.5, range=0..3)
audiowave = AudioWave(AudioFile=path, XOffset=x_offset, Skip=skip)  # -> Peak, Points, Length
play = AudioPlay(AudioFile=path, Boolean=toggle)
split_list = SplitList(List=audiowave.Points, Index=stop)  # -> ListA, ListB
split_list_2 = SplitList(List=split_list.ListA, Index=start)  # -> ListA, ListB
divide_list = DivideList(List=split_list_2.ListB, Number=divisions)  # -> Chunk, Remainder
series = Series(Start=0, Step=y_factor, Count=divisions)
interpolate = Interpolate(Vertices=divide_list.Chunk, Degree=3, Periodic=False, KnotStyle=1)  # -> Curve, Length, Domain
scale_nu = ScaleNU(Geometry=interpolate.Curve, Plane=PlaneXY(0, 0, 0), ScaleX=1, ScaleY=1, ScaleZ=z_factor)  # -> Geometry, Transform
unit_y = UnitY(Factor=graft(series))
end_points = EndPoints(Curve=scale_nu.Geometry)  # -> Start, End
loft_type = ValueList({"Normal": 0, "Loose": 1, "Tight": 2, "Straight": 3, "Uniform": 5}, selected="Normal")
move_to_point = MoveToPoint(Geometry=scale_nu.Geometry, PointA=end_points.Start, PointB=unit_y)  # -> flatten(Moved), Vector, Transform
loft_options = LoftOptions(Closed=Toggle(False), Adjust=False, Rebuild=0, Refit=0, Type=loft_type)
loft = Loft(Curves=move_to_point.Moved, Options=loft_options)

# ---- group: morph waveform around cylinder
surface = Surface(loft)
# waveform vase
bounding_box = BoundingBox(Content=surface, Plane=PlaneXY(0, 0, 0))  # -> Box, Box_2
cylinder = Cylinder(Base=PlaneXY(0, 0, 0), Radius=Slider(3, range=0..10), Length=Slider(16.5, range=0..100))
distance = Slider(0.25, range=0..1)
surface_morph = SurfaceMorph(
    Geometry=surface,
    Reference=bounding_box.Box,
    Surface=cylinder,
    UDomain="1.9*PI",
    VDomain=Slider(8, range=0..20),
    WDomain=Slider(2, range=0..10))
value_list = ValueList({"One": 1, "Two": 2, "Three": 2² - 1, "Four": Sqrt(16)}, selected="One")
contour = Contour(Shape=surface_morph, Point=Point(0, 0, 0), Direction=Vector(0, 0, 1), Distance=distance)
close_curve = CloseCurve(Curve=contour, CloseType=value_list, Bulge=0.5, Tolerance=0)  # -> Closed, ResultBoolean
list_length = ListLength(List=flatten(close_curve.Closed))
subtraction = Subtraction(A=list_length, B="1")
value_list_2 = ValueList({"One": 1, "Two": 2, "Three": 2² - 1, "Four": Sqrt(16)}, selected="One")
range = Range(Domain="0.75 To 1", Steps=subtraction)
scale_nu_2 = ScaleNU(Geometry=flatten(close_curve.Closed), Plane=PlaneXY(0, 0, 0), ScaleX=range, ScaleY=range, ScaleZ=1)  # -> Geometry, Transform
loft_options_2 = LoftOptions(Closed=False, Adjust=False, Rebuild=0, Refit=0, Type=value_list_2)
loft_2 = Loft(Curves=flatten(scale_nu_2.Geometry), Options=loft_options_2)
