# Grasshopper definition space-filling-vase.gh (Grasshopper 1.0.7)
# plug-ins: Pufferfish

# ----
# space filling vase
curve = Curve(<curve referenced from the Rhino model>)
curve_2 = Curve(<curve referenced from the Rhino model>)
Z = Slider(36, range=0..100)
unit_z = UnitZ(Factor=Z)
move = Move(Geometry=curve_2, Motion=unit_z)  # -> Geometry, Transform
range = Range(Domain=Domain(0, 1), Steps=10)
tween_two_curves = TweenTwoCurves(CurveA=curve, CurveB=move.Geometry, Factor=range, Refit=0, PointSample=0)
loft = Loft(
    Curves=tween_two_curves,
    Options={Adjust=False, Closed=False, LoftEnds=0, LoftSimp=0, LoftType=0, Rebuild=10, Refit=0.01})
custom_preview = CustomPreview(Geometry=loft, Material=ColourSwatch(SwatchColor=RGB(230, 230, 230)))

Z_2 = Slider(60, range=0..100)
curve_3 = Curve(<curve referenced from the Rhino model>)
curve_4 = Curve(<curve referenced from the Rhino model>)
unit_z_2 = UnitZ(Factor=Z_2)
move_2 = Move(Geometry=curve_4, Motion=unit_z_2)  # -> Geometry, Transform
range_2 = Range(Domain=Domain(0, 1), Steps=10)
tween_two_curves_2 = TweenTwoCurves(CurveA=curve_3, CurveB=move_2.Geometry, Factor=range_2, Refit=0, PointSample=0)
range_3 = Range(Domain="0.5 To 1.5", Steps=10)
graph_mapper = GraphMapper(
    range_3,
    x0=0.5,
    x1=1.5,
    y0=0.5,
    y1=1.5,
    container_name="Bezier",
    cpx=[0, 0.4248798788, 0.2934791446, 1],
    cpy=[0, 0.4785019159, 0.8152169585, 1])
scale_nu = ScaleNU(Geometry=tween_two_curves_2, Plane=PlaneXY(0, 0, 0), ScaleX=graph_mapper, ScaleY=graph_mapper, ScaleZ=1)  # -> Geometry, Transform
loft_2 = Loft(
    Curves=scale_nu.Geometry,
    Options={Adjust=False, Closed=False, LoftEnds=0, LoftSimp=0, LoftType=0, Rebuild=10, Refit=0.01})
custom_preview_2 = CustomPreview(Geometry=loft_2, Material=ColourSwatch(SwatchColor=RGB(230, 230, 230)))

curve_5 = Curve(<curve referenced from the Rhino model>)
curve_6 = Curve(<curve referenced from the Rhino model>)
Z_3 = Slider(60, range=0..100)
unit_z_3 = UnitZ(Factor=Z_3)
move_3 = Move(Geometry=curve_6, Motion=unit_z_3)  # -> Geometry, Transform
range_4 = Range(Domain=Domain(0, 1), Steps=10)
tween_two_curves_3 = TweenTwoCurves(CurveA=curve_5, CurveB=move_3.Geometry, Factor=range_4, Refit=0, PointSample=0)
range_5 = Range(Domain="0 To 1", Steps=10)
graph_mapper_2 = GraphMapper(
    range_5,
    x0=0,
    x1=1,
    y0=0,
    y1=1,
    container_name="Bezier",
    cpx=[0, 0.3345416486, 0.7657010555, 1],
    cpy=[0.3333324194, 0.7644918561, 0.5419320464, 0.8548300862])
scale_nu_2 = ScaleNU(Geometry=tween_two_curves_3, Plane=PlaneXY(0, 0, 0), ScaleX=graph_mapper_2, ScaleY=graph_mapper_2, ScaleZ=1)  # -> Geometry, Transform
loft_3 = Loft(
    Curves=scale_nu_2.Geometry,
    Options={Adjust=False, Closed=False, LoftEnds=0, LoftSimp=0, LoftType=0, Rebuild=10, Refit=0.01})
custom_preview_3 = CustomPreview(Geometry=loft_3, Material=ColourSwatch(SwatchColor=RGB(230, 230, 230)))

curve_7 = Curve(<curve referenced from the Rhino model>)
curve_8 = Curve(<curve referenced from the Rhino model>)
Z_4 = Slider(60, range=0..100)
unit_z_4 = UnitZ(Factor=Z_4)
move_4 = Move(Geometry=curve_8, Motion=unit_z_4)  # -> Geometry, Transform
range_6 = Range(Domain=Domain(0, 1), Steps=10)
tween_two_curves_4 = TweenTwoCurves(CurveA=curve_7, CurveB=move_4.Geometry, Factor=range_6, Refit=0, PointSample=0)
range_7 = Range(Domain="0.5 To 1.5", Steps=10)
graph_mapper_3 = GraphMapper(
    range_7,
    x0=0,
    x1=1,
    y0=0,
    y1=1,
    container_name="Bezier",
    cpx=[0, 0.7053142786, 0.4541068673, 1],
    cpy=[0.1956521869, 0.4903378487, 1, 1])
scale_nu_3 = ScaleNU(Geometry=tween_two_curves_4, Plane=PlaneXY(0, 0, 0), ScaleX=graph_mapper_3, ScaleY=graph_mapper_3, ScaleZ=1)  # -> Geometry, Transform
loft_4 = Loft(
    Curves=scale_nu_3.Geometry,
    Options={Adjust=False, Closed=False, LoftEnds=0, LoftSimp=0, LoftType=0, Rebuild=10, Refit=0.01})
custom_preview_4 = CustomPreview(Geometry=loft_4, Material=ColourSwatch(SwatchColor=RGB(230, 230, 230)))

curve_9 = Curve(<curve referenced from the Rhino model>)
curve_10 = Curve(<curve referenced from the Rhino model>)
Z_5 = Slider(36, range=0..100)
unit_z_5 = UnitZ(Factor=Z_5)
move_5 = Move(Geometry=curve_10, Motion=unit_z_5)  # -> Geometry, Transform
range_8 = Range(Domain=Domain(0, 1), Steps=10)
tween_two_curves_5 = TweenTwoCurves(CurveA=curve_9, CurveB=move_5.Geometry, Factor=range_8, Refit=0, PointSample=0)
range_9 = Range(Domain="0 To 1", Steps=10)
graph_mapper_4 = GraphMapper(
    range_9,
    x0=0,
    x1=1,
    y0=0,
    y1=1,
    container_name="Bezier",
    cpx=[0, 0.1967534572, 0.441113472, 1],
    cpy=[1, 0.6295458078, 0.6874203682, 0.8117436767])
scale_nu_4 = ScaleNU(Geometry=tween_two_curves_5, Plane=PlaneXY(0, 0, 0), ScaleX=graph_mapper_4, ScaleY=graph_mapper_4, ScaleZ=1)  # -> Geometry, Transform
loft_5 = Loft(
    Curves=scale_nu_4.Geometry,
    Options={Adjust=False, Closed=False, LoftEnds=0, LoftSimp=0, LoftType=0, Rebuild=10, Refit=0.01})
custom_preview_5 = CustomPreview(Geometry=loft_5, Material=ColourSwatch(SwatchColor=RGB(230, 230, 230)))

curve_11 = Curve(<curve referenced from the Rhino model>)
curve_12 = Curve(<curve referenced from the Rhino model>)
Z_6 = Slider(60, range=0..100)
unit_z_6 = UnitZ(Factor=Z_6)
move_6 = Move(Geometry=curve_12, Motion=unit_z_6)  # -> Geometry, Transform
range_10 = Range(Domain=Domain(0, 1), Steps=10)
tween_two_curves_6 = TweenTwoCurves(CurveA=curve_11, CurveB=move_6.Geometry, Factor=range_10, Refit=0, PointSample=0)
range_11 = Range(Domain="0 To 1", Steps=10)
graph_mapper_5 = GraphMapper(
    range_11,
    x0=0,
    x1=1,
    y0=0,
    y1=1,
    container_name="Bezier",
    cpx=[0, 0.3345416486, 0.7657010555, 1],
    cpy=[0.3333324194, 0.7644918561, 0.5419320464, 0.8548300862])
scale_nu_5 = ScaleNU(Geometry=tween_two_curves_6, Plane=PlaneXY(0, 0, 0), ScaleX=graph_mapper_5, ScaleY=graph_mapper_5, ScaleZ=1)  # -> Geometry, Transform
range_12 = Range(Domain="0 To 90", Steps=10)
rotate = Rotate(Geometry=scale_nu_5.Geometry, Angle=degrees(range_12), Plane=PlaneXY(0, 0, 0))  # -> Geometry, Transform
loft_6 = Loft(Curves=rotate.Geometry, Options={Adjust=False, Closed=False, LoftEnds=0, LoftSimp=0, LoftType=0, Rebuild=10, Refit=0.01})
custom_preview_6 = CustomPreview(Geometry=loft_6, Material=ColourSwatch(SwatchColor=RGB(230, 230, 230)))

radius = Slider(36, range=0..100)
curve_13 = Curve(<curve referenced from the Rhino model>)
Z_7 = Slider(60, range=0..100)
unit_z_7 = UnitZ(Factor=Z_7)
move_7 = Move(Geometry=curve_13, Motion=unit_z_7)  # -> Geometry, Transform
range_13 = Range(Domain=Domain(0, 1), Steps=10)
circle = Circle(Plane=PlaneXY(0, 0, 0), Radius=radius)
tween_two_curves_7 = TweenTwoCurves(CurveA=circle, CurveB=move_7.Geometry, Factor=range_13, Refit=0, PointSample=0)
range_14 = Range(Domain="0 To 1", Steps=10)
graph_mapper_6 = GraphMapper(
    range_14,
    x0=0,
    x1=1,
    y0=0,
    y1=1,
    container_name="Bezier",
    cpx=[0, 0.3345416486, 0.7657010555, 1],
    cpy=[0.3333324194, 0.7644918561, 0.5419320464, 0.8548300862])
scale_nu_6 = ScaleNU(Geometry=tween_two_curves_7, Plane=PlaneXY(0, 0, 0), ScaleX=graph_mapper_6, ScaleY=graph_mapper_6, ScaleZ=1)  # -> Geometry, Transform
range_15 = Range(Domain="60", Steps=10)
rotate_2 = Rotate(Geometry=scale_nu_6.Geometry, Angle=degrees(range_15), Plane=PlaneXY(0, 0, 0))  # -> Geometry, Transform
loft_7 = Loft(
    Curves=rotate_2.Geometry,
    Options={Adjust=False, Closed=False, LoftEnds=0, LoftSimp=0, LoftType=0, Rebuild=10, Refit=0.01})
custom_preview_7 = CustomPreview(Geometry=loft_7, Material=ColourSwatch(SwatchColor=RGB(230, 230, 230)))
