# Grasshopper definition wearables.gh (Grasshopper 1.0.7)
# Copyright: GNU General Public License
# plug-ins: EleFront, Kangaroo2 Components

# ---- group: generate grid
# wearables
# voronoi attractor
cell_size = Slider(10, range=0..100)
X = Slider(200, range=0..1000)
Y = Slider(50, range=0..1000)
rectangle = Rectangle(Plane=PlaneXY(0, 0, 0), XSize=X, YSize=Y, Radius=0)  # -> Rectangle, Length
division = Division(A=X, B=cell_size)
division_2 = Division(A=Y, B=cell_size)
square = Square(Plane=PlaneXY(0, 0, 0), Size=cell_size, ExtentX=division, ExtentY=division_2)  # -> Cells, Points
grid = Point(flatten(square.Points))
region = Rectangle(rectangle.Rectangle)

# ---- group: set multiple attractors
point = Point([Point(18, 6, 0), Point(31, 18, 0), Point(76, 42, 0), Point(97, 6, 0), Point(110, 21, 0), Point(130, 8, 0), Point(169, 45, 0), Point(195, 17, 0)])

# ----
grid_2 = Point(grid)
domain = Slider(30, range=0..100)
closest_point = ClosestPoint(Point=grid_2, Cloud=point)  # -> ClosestPoint, CPIndex, Distance
bounds = Bounds(Numbers=closest_point.Distance)
negative = Negative(Value=domain)
remap_numbers = RemapNumbers(Value=closest_point.Distance, Source=bounds, Target=[negative, domain])  # -> Mapped, Clipped
unit_x = UnitX(Factor=remap_numbers.Mapped)
unit_y = UnitY(Factor=remap_numbers.Mapped)
move = Move(Geometry=grid_2, Motion=unit_x)  # -> Geometry, Transform
move_2 = Move(Geometry=move.Geometry, Motion=unit_y)  # -> Geometry, Transform
points = Point(move_2.Geometry)

# ---- group: create cell boundaries
points_2 = Point(points)
region_2 = Rectangle(region)
scaling = Slider(0.7, range=0..1)
voronoi = Voronoi(Points=points_2, Boundary=region_2, BruteForceOverride=False)
polygon_center = PolygonCenter(Polyline=voronoi)  # -> CenterV, CenterE, CenterA
scale = Scale(Geometry=voronoi, Center=polygon_center.CenterA, Factor=scaling)  # -> Geometry, Transform
boundary_surfaces = BoundarySurfaces(Edges=[voronoi, scale.Geometry])
surface = Surface(boundary_surfaces)

# ---- group: bake to layer
# using elefront
surface_2 = Surface(surface)
layer = Panel("voronoi-")
iteration = Slider(1, range=0..10)
concatenate = Concatenate(FragmentA=layer, FragmentB=iteration)
define_layer = DefineLayer(Name=concatenate)
define_object_attributes = DefineObjectAttributes(Layer=define_layer)
bake_objects = BakeObjects(Geometry=surface_2, Attributes=define_object_attributes, Bake=False)

# ---- group: set region / set multiple attractors
point_2 = Point(Point(130, 21, 0))

# ---- group: space filling curve / run & reset
boolean_toggle = BooleanToggle(False)
boolean_toggle_2 = BooleanToggle(False)

# ---- group: populate boundary
point_spacing = Slider(0.5, range=0..1)
amplitude = Slider(0.15, range=0..1)
seed = Slider(2, range=0..10)

# ---- group: inset
offset = Slider(2, range=0..10)  # disabled
negative_2 = Negative(Value=offset)  # disabled

# ---- group: set region
# space filling curve
X_2 = Slider(200, range=0..1000)
Y_2 = Slider(50, range=0..1000)
offset_2 = Slider(5, range=0..10)
list_length = ListLength(List=point_2)
rectangle_2 = Rectangle(Plane=PlaneXY(0, 0, 0), XSize=X_2, YSize=Y_2, Radius=0)  # -> Rectangle, Length
negative_3 = Negative(Value=offset_2)
random = Random(Range="3 To 6", Number=list_length, Seed=2)
offset_curve = OffsetCurve(Curve=rectangle_2.Rectangle, Distance=negative_3, Plane=PlaneXY(0, 0, 0), Corners=1)
circle = Circle(Plane=point_2, Radius=random)
region_difference = RegionDifference(CurvesA=offset_curve, CurvesB=circle)
boundary_surfaces_2 = BoundarySurfaces(Edges=region_difference)
curve = Curve(rectangle_2.Rectangle)
curve_2 = Curve(offset_curve)
surface_3 = Surface(boundary_surfaces_2)

# ---- group: populate boundary (continued)
curve_3 = Curve(offset_curve)
divide_length = DivideLength(Curve=curve_3, Length=point_spacing)  # -> simplify(Points), Tangents, Parameters
amplitude_2 = Amplitude(Vector=divide_length.Points, Amplitude=amplitude)
list_length_2 = ListLength(List=amplitude_2)
random_2 = Random(Range="0 To 2*PI", Number=list_length_2, Seed=seed)
rotate = Rotate(Geometry=amplitude_2, Angle=random_2, Plane=PlaneXY(0, 0, 0))  # -> simplify(Geometry), Transform
move_3 = Move(Geometry=divide_length.Points, Motion=rotate.Geometry)  # -> Geometry, Transform
point_3 = Point(move_3.Geometry)

# ----
X_3 = Number(X_2)
Y_3 = Number(Y_2)

# ---- group: set region (continued)
mesh_surface = MeshSurface(Surface=boundary_surfaces_2, UCount=X_3, VCount=Y_3, Overhang=True, Equalize=False)
mesh = Mesh(mesh_surface)

# ---- group: space filling curve
mesh_2 = Mesh(mesh)
point_4 = Point(point_3)
point_5 = Point(point_3)
point_6 = Point(point_3)
list_length_3 = ListLength(List=point_6)
polyline = PolyLine(Vertices=point_5, Closed="True")  # -> flatten(Polyline)
series = Series(Start=0, Step=1, Count=list_length_3)
partition_list = PartitionList(List=series, Size=list_length_3)
explode = Explode(Curve=polyline, Recursive=True)  # -> Segments, Vertices
line = Line(explode.Segments)
list_length_4 = ListLength(List=line)
series_2 = Series(Start=0, Step=1, Count=list_length_4)
partition_list_2 = PartitionList(List=series_2, Size=list_length_4)
shift_list = ShiftList(List=partition_list_2, Shift=1, Wrap=True)
shift_list_2 = ShiftList(List=partition_list, Shift=1, Wrap=True)
shift_list_3 = ShiftList(List=explode.Segments, Shift=1, Wrap=True)
integer = Integer(partition_list_2)
integer_2 = Integer(partition_list)
integer_3 = Integer(shift_list_2)
integer_4 = Integer(shift_list)
length_line = LengthLine(Line=flatten(explode.Segments), Length="6", Strength="10")
show = Show(G=polyline)
angle = Angle(LineA=explode.Segments, LineB=shift_list_3, RestAngle="0", Strength="1000")
collider = Collider(Objects=point_6, Radii="2", IgnoreA=integer_2, IgnoreB=integer_3, Strength="100")
onmesh = OnMesh(Points=point_4, Mesh=mesh_2, Strength="1000")
collider_2 = Collider(Objects=line, Radii="2", IgnoreA=integer, IgnoreB=integer_4, Strength="100")
entwine = Entwine(
    Branch00=show,
    Branch01=onmesh,
    Branch02=length_line,
    Branch03=angle,
    Branch04=collider,
    Branch05=collider_2,
    FlattenInputs=True)
solver = Solver(GoalObjects=entwine, Reset=boolean_toggle_2, Threshold=0, Tolerance=0.01, On=boolean_toggle)  # -> I, V, O
fillet = Fillet(Curve=solver.O, Radius="10")  # -> flatten(Curve)
join_curves = JoinCurves(Curves=fillet, Preserve=False)
curve_4 = Curve(join_curves)

# ---- group: cutout
surface_4 = Surface(curve)  # disabled
curve_5 = Curve(curve_4)  # disabled
boundary_surfaces_3 = BoundarySurfaces(Edges=curve_5)  # disabled
solid_difference = SolidDifference(BrepsA=surface_4, BrepsB=boundary_surfaces_3)  # disabled

# ---- group: inset (continued)
curve_6 = Curve(curve_4)  # disabled
curve_7 = Curve(curve)  # disabled
curve_8 = Curve(curve_2)  # disabled
offset_curve_2 = OffsetCurve(Curve=curve_8, Distance=negative_2, Plane=PlaneXY(0, 0, 0), Corners=1)  # disabled
boundary_surfaces_4 = BoundarySurfaces(Edges=flatten([curve_7, offset_curve_2]))  # disabled
boundary_surfaces_5 = BoundarySurfaces(Edges=curve_6)  # disabled
solid_intersection = SolidIntersection(BrepsA=boundary_surfaces_4, BrepsB=boundary_surfaces_5)  # disabled
merge_faces = MergeFaces(Brep=solid_intersection)  # -> Breps, Before, After; disabled

# ---- group: bake to layer
# using elefront
surface_5 = Surface(solid_difference)  # disabled
layer_2 = Panel("space-filling-")  # disabled
iteration_2 = Slider(1, range=0..10)  # disabled
concatenate_2 = Concatenate(FragmentA=layer_2, FragmentB=iteration_2)  # disabled
define_layer_2 = DefineLayer(Name=concatenate_2)  # disabled
define_object_attributes_2 = DefineObjectAttributes(Layer=define_layer_2)  # disabled
bake_objects_2 = BakeObjects(Geometry=surface_5, Attributes=define_object_attributes_2, Bake=False)  # disabled

# using elefront
surface_6 = Surface(merge_faces.Breps)  # disabled
layer_3 = Panel("space-filling-")  # disabled
iteration_3 = Slider(2, range=0..10)  # disabled
concatenate_3 = Concatenate(FragmentA=layer_3, FragmentB=iteration_3)  # disabled
define_layer_3 = DefineLayer(Name=concatenate_3)  # disabled
define_object_attributes_3 = DefineObjectAttributes(Layer=define_layer_3)  # disabled
bake_objects_3 = BakeObjects(Geometry=surface_6, Attributes=define_object_attributes_3, Bake=False)  # disabled
