# Grasshopper definition flow-field.gh (Grasshopper 1.0.7)
# plug-ins: Pufferfish

# ---- group: vector flow field
# flows
count = Slider(4, range=0..100)
seed = Slider(34, range=0..100)
decay = Slider(0.6, range=0.1..5)
cell_size = Slider(1, range=0..10)
extent_x = Slider(20, range=0..100)
extent_y = Slider(20, range=0..100)
hexagonal = Hexagonal(Plane=PlaneXY(0, 0, 0), Size=cell_size, ExtentX=extent_x, ExtentY=extent_y)  # -> Cells, Points
bounding_rectangle = BoundingRectangle(Geometry=flatten(hexagonal.Cells), Plane=PlaneXY(0, 0, 0), Axis=0, Slide=0, Union=True)  # -> Bounding, DimensionX, DimensionY
populate_2d = Populate2D(Region=bounding_rectangle.Bounding, Count=count, Seed=seed)
point_charge = PointCharge(Point=populate_2d, Charge=1, Decay=decay, Bounds=bounding_rectangle.Bounding)
merge_fields = MergeFields(Fields=point_charge)
field_line = FieldLine(Field=merge_fields, Point=hexagonal.Points, Steps=1000, Accuracy=0.1, Method=3)
custom_preview = CustomPreview(Geometry=field_line, Material=ColourSwatch(SwatchColor=RGB(0, 0, 0)))

# ----
curve = Curve(hexagonal.Cells)
point = Point(hexagonal.Points)
scale = Slider(0.9, range=0..1)
curve_2 = Curve(field_line)
scale_nu = ScaleNU(Geometry=curve, Plane=point, ScaleX=scale, ScaleY=scale, ScaleZ=1)  # -> Geometry, Transform
trim_with_region = TrimWithRegion(Curve=graft(curve_2), Region=flatten(scale_nu.Geometry))  # -> Inside, Outside; disabled
colour_swatch = ColourSwatch(SwatchColor=RGB(0, 0, 0))  # disabled
custom_preview_2 = CustomPreview(Geometry=scale_nu.Geometry, Material=ColourSwatch(SwatchColor=RGB(255, 255, 255)))
custom_preview_3 = CustomPreview(Geometry=trim_with_region.Inside, Material=colour_swatch)  # disabled

panel = Panel("toolpath in RhinoCAM")
