# Grasshopper definition flume.gh (Grasshopper 1.0.7)
# Copyright: GNU General Public License
# plug-ins: Docofossor

size = Slider(5, range=0..10)
X = Slider(5, range=0..100)
Y = Slider(10, range=0..100)
start = Slider(0.75, range=0..1)
step = Slider(-0.1, range=-1..0)
count = Slider(4, range=0..10)
hexagonal = Hexagonal(Plane="5,5,0", Size=size, ExtentX=X, ExtentY=Y)  # -> flatten(Cells), flatten(Points)
series = Series(Start=start, Step=step, Count=count)
series_2 = Series(Start=0, Step="0.25", Count=count)
scale = Scale(Geometry=hexagonal.Cells, Center=hexagonal.Points, Factor=graft(series))  # -> Geometry, Transform
unit_z = UnitZ(Factor=series_2)
move = Move(Geometry=scale.Geometry, Motion=graft(unit_z))  # -> flatten(Geometry), Transform
curve = Curve(move.Geometry)

cell_size = Slider(0.5, range=0..1)
Y_2 = Slider(190, range=0..1000)
curve_2 = Curve(curve)
X_2 = Slider(80, range=0..1000)
square = Square(Plane=PlaneXY(0, 0, 0), Size=cell_size, ExtentX=X_2, ExtentY=Y_2)  # -> Cells, flatten(Points)
yz_plane = YZPlane(Origin=Point(0, 0, 0))
yz_plane_2 = YZPlane(Origin=Point(0, 0, 0))
rotate = Rotate(Geometry=square.Points, Angle=degrees("-1"), Plane=yz_plane)  # -> Geometry, Transform
rotate_2 = Rotate(Geometry=curve_2, Angle=degrees("-1"), Plane=yz_plane_2)  # -> Geometry, Transform
import_points = ImportPoints(Pts=rotate.Geometry)
cut_fill_in_path = CutFillInPath(Df=import_points, Crv=rotate_2.Geometry, W="1", Sa="-5", Sa2="45", D="5")  # -> Df, Vol
grid_mesh = GridMesh(Df=cut_fill_in_path.Df)
custom_preview = CustomPreview(Geometry=grid_mesh, Material=ColourSwatch(SwatchColor=RGB(230, 230, 230)))
export_xyz = ExportXYZ(Df=cut_fill_in_path.Df, F="flume", W=Toggle(True))
