# Grasshopper definition grading.gh (Grasshopper 1.0.7)
# Copyright: GNU General Public License 3.0
# plug-ins: Volvox, Docofossor

# ---- group: import xyz
# Grading
# using docofossor
file_path = FilePath("D:\generative-design\grasshopper\data\governors-island-landform.xyz")
import_xyz = ImportXYZ(F=file_path, N="5")
grid_shift = GridShift(Df=import_xyz)
grid_mesh = GridMesh(Df=grid_shift)
custom_preview = CustomPreview(Geometry=grid_mesh, Material=ColourSwatch(SwatchColor=RGB(204, 204, 204)))
data = Data(grid_shift)

# ---- group: grade landform
data_2 = Data(data)
point = Point([Point(1434.689998, 510.3763378, 13.94260624), Point(1511.391316, 433.4226305, 31.19747816), Point(1564.602701, 277.4035744, 44.58193641), Point(1587.519157, 192.840311, 28.93347186), Point(1574.537691, 122.7234625, 14.98211894)])
width = Slider(0.1, range=0..0.1)
slope_l = Slider(33, range=0..100)
slope_r = Slider(20, range=0..100)
distance = Slider(100, range=0..100)
interpolate = Interpolate(Vertices=point, Degree=3, Periodic=False, KnotStyle=1)  # -> Curve, Length, Domain
fill_in_path = FillInPath(Df=data_2, Crv=interpolate.Curve, Wt=width, Sa=slope_l, Sa2=slope_r, D=distance)  # -> Df, Vol
grid_mesh_2 = GridMesh(Df=fill_in_path.Df)
custom_preview_2 = CustomPreview(Geometry=grid_mesh_2, Material=ColourSwatch(SwatchColor=RGB(204, 204, 204)))
data_3 = Data(fill_in_path.Df)

# ---- group: calculate cut and fill
data_4 = Data(data)
data_5 = Data(data_3)
grid_compare = GridCompare(Df1=data_4, Df2=data_5)  # -> Cut, Fill, Balance, Df
grid_mesh_3 = GridMesh(Df=grid_compare.Df)
panel = Panel(grid_compare.Cut)
panel_2 = Panel(grid_compare.Fill)
custom_preview_3 = CustomPreview(Geometry=grid_mesh_3, Material=ColourSwatch(SwatchColor=RGB(204, 204, 204)))

# ---- group: transform
data_6 = Data(data_3)
grid_global = GridGlobal(Df=data_6)
grid_mesh_4 = GridMesh(Df=grid_global)

# ----
area = Area(Geometry=grid_mesh_4)  # -> Area, Centroid

# ---- group: transform (continued)
xz_plane = XZPlane(Origin=area.Centroid)
mirror = Mirror(Geometry=grid_mesh_4, Plane=xz_plane)  # -> Geometry, Transform
mesh = Mesh(mirror.Geometry)

# ---- group: export xyz
# using volvox
mesh_2 = Mesh(mesh)
face_normals = FaceNormals(Mesh=mesh_2)  # -> Centers, Normals
construct_cloud = ConstructCloud(Points=face_normals.Centers)
file_path_2 = FilePath("D:\generative-design\grasshopper\data\governors-island-grading.xyz")
save_xyz = SaveXyz(
    Cloud=construct_cloud,
    FilePath=file_path_2,
    Mask="x y z",
    Precision="0.01",
    DoubleQuotes=False,
    Run=Toggle(False),
    Abort=False)
