# Grasshopper definition curve-array.gh (Grasshopper 1.0.7)
# plug-ins: Pufferfish

# ---- group: generate a conical tree
# parametric tree
# diameter at breast height (DBH)
trunk_diameter = Slider(0.75, range=0..2)
trunk_height = Slider(8, range=0..100)
crown_height = Slider(30, range=0..75)
canopy_layers = Slider(3, range=0..10)
canopy_diameter = Slider(10, range=0..100)
conical_tree = ConicalTree(A=trunk_diameter, factor=trunk_height, factor_2=crown_height, B=canopy_layers, A_2=canopy_diameter)  # -> trunk, result
canopy_color = ColourSwatch(SwatchColor=RGBA(58, 94, 58, 232))
trunk_color = ColourSwatch(SwatchColor=RGB(139, 76, 57))
custom_preview = CustomPreview(Geometry=conical_tree.trunk, Material=trunk_color)
custom_preview_2 = CustomPreview(Geometry=conical_tree.result, Material=canopy_color)

# ---- group: parameters
canopies = Geometry(conical_tree.result)
# array along path
trunks = Geometry(conical_tree.trunk)
point = Point([Point(0, 0, 0), Point(50.72201209, 49.36208238, 0), Point(130.2970337, -48.01902382, 0), Point(232.7207017, 109.2079192, 0), Point(334.4037509, -43.27998677, 0)])
number = Number(Slider(36, range=0..100))

# ----
origin = Panel("0,0,0")

# ---- group: array canopies along path
# from pufferfish
range = Range(Domain=Domain(0, 1), Steps=number)
interpolate_data = InterpolateData(Data=point, Parameter=range, Interpolation=4)
move_to_point = MoveToPoint(Geometry=canopies, PointA=origin, PointB=interpolate_data)  # -> Moved, Vector, Transform
random = Random(Range="0.75 To 1.0", Number=number, Seed=2)
scale = Scale(Geometry=move_to_point.Moved, Center=interpolate_data, Factor=random)  # -> Geometry, Transform

# ----
origin_2 = Panel("0,0,0")

# ---- group: array trunks along path
# from pufferfish
range_2 = Range(Domain=Domain(0, 1), Steps=number)
interpolate_data_2 = InterpolateData(Data=point, Parameter=range_2, Interpolation=4)
move_to_point_2 = MoveToPoint(Geometry=trunks, PointA=origin_2, PointB=interpolate_data_2)  # -> Moved, Vector, Transform

# ---- group: trunk color
# color
trunk_color_2 = ColourSwatch(SwatchColor=RGB(139, 76, 57))
custom_preview_3 = CustomPreview(Geometry=move_to_point_2.Moved, Material=trunk_color_2)

# ---- group: canopy color gradient
canopy_color_2 = ColourSwatch(SwatchColor=RGBA(191, 115, 48, 232))
canopy_color_3 = ColourSwatch(SwatchColor=RGBA(128, 64, 64, 232))
canopy_color_4 = ColourSwatch(SwatchColor=RGBA(58, 94, 58, 232))
colour = Colour([canopy_color_4, canopy_color_2, canopy_color_3])
range_3 = Range(Domain="-1 To 1", Steps=number)
interpolate_data_3 = InterpolateData(Data=colour, Parameter=range_3, Interpolation=2)
custom_preview_4 = CustomPreview(Geometry=scale.Geometry, Material=interpolate_data_3)

# ==== cluster ConicalTree
factor = ClusterInput()
factor_2 = ClusterInput()
A = ClusterInput()
A_2 = ClusterInput()

# ---- group: conical tree
construct_point = ConstructPoint(XCoordinate=0, YCoordinate=0, ZCoordinate=0)
unit_z = UnitZ(Factor=factor)
unit_z_2 = UnitZ(Factor=factor_2)
division = Division(A=A, B="2.0")
division_2 = Division(A=A_2, B="2.0")
B = ClusterInput()
move = Move(Geometry=construct_point, Motion=unit_z_2)  # -> Geometry, Transform
move_2 = Move(Geometry=construct_point, Motion=unit_z)  # -> Geometry, Transform
division_3 = Division(A=unit_z_2, B=B)
line = Line(StartPoint=construct_point, EndPoint=move_2.Geometry)
line_2 = Line(StartPoint=move_2.Geometry, EndPoint=move.Geometry)
divide_distance = DivideDistance(Curve=line_2, Distance=division_3)  # -> Points, Tangents, Parameters
construct_plane = ConstructPlane(Origin=divide_distance.Points, XAxis=Vector(1, 0, 0), YAxis=Vector(0, 1, 0))
construct_domain = ConstructDomain(DomainStart="0.5", DomainEnd="1.75")
cone = Cone(Base=construct_plane, Radius=division_2, Length=division_3)  # -> Cone, Tip
list_length = ListLength(List=construct_plane)
range = Range(Domain=construct_domain, Steps=list_length)  # -> reverse(Range)
scale = Scale(Geometry=cone.Cone, Center=construct_plane, Factor=range)  # -> Geometry, Transform
pipe = Pipe(Curve=line, Radius=division, Caps=0)
cap_holes = CapHoles(Brep=scale.Geometry)
solid_union = SolidUnion(Breps=cap_holes)

# ----
trunk = ClusterOutput(pipe)
result = ClusterOutput(solid_union)
