# Grasshopper definition ecological-gradient.gh (Grasshopper 1.0.7)

# ---- group: generate a conical tree
# parametric tree
# diameter at breast height (DBH)
trunk_diameter = Slider(0.75, range=0..2)
trunk_height = Slider(8, range=0..100)
crown_height = Slider(30, range=0..75)
canopy_layers = Slider(3, range=0..10)
canopy_diameter = Slider(10, range=0..100)
conical_tree = ConicalTree(A=trunk_diameter, factor=trunk_height, factor_2=crown_height, B=canopy_layers, A_2=canopy_diameter)  # -> trunk, result
trunk_color = ColourSwatch(SwatchColor=RGB(139, 76, 57))
canopy_color = ColourSwatch(SwatchColor=RGBA(58, 94, 58, 232))
custom_preview = CustomPreview(Geometry=conical_tree.trunk, Material=trunk_color)
custom_preview_2 = CustomPreview(Geometry=conical_tree.result, Material=canopy_color)

# ---- group: cull trees from a random population
count = Slider(360, range=0..1000)
y_percentage = Slider(0.75, range=0..1)
# culled forest
xy = Slider(150, range=0..360)
start = Slider(0, range=0..1)
end = Slider(1, range=0..1)
scale = Slider(0.5, range=0..1)
construct_domain = ConstructDomain(DomainStart=start, DomainEnd=end)
rectangle = Rectangle(Plane=PlaneXY(0, 0, 0), XSize=xy, YSize=xy, Radius=0)  # -> Rectangle, Length
multiplication = Multiplication(A=xy, B=y_percentage)
populate_2d = Populate2D(Region=rectangle.Rectangle, Count=count, Seed=1)
construct_point = ConstructPoint(XCoordinate=0, YCoordinate=multiplication, ZCoordinate=0)
line = Line(StartPoint=Point(0, 0, 0), EndPoint=construct_point)
list_length = ListLength(List=populate_2d)
curve_closest_point = CurveClosestPoint(Point=populate_2d, Curve=line)  # -> Point, Parameter, Distance
random = Random(Range=construct_domain, Number=list_length, Seed=2)
addition = Addition(A=random, B=curve_closest_point.Parameter)
sort_list = SortList(Keys=addition, ValuesValuesA=populate_2d)  # -> Keys, ValuesValuesA
multiplication_2 = Multiplication(A=list_length, B=scale)
sub_list = SubList(List=sort_list.ValuesValuesA, Domain=multiplication_2, Wrap=True)  # -> List, Index
list_length_2 = ListLength(List=sub_list.List)

# ---- group: color
tree_trunk = Geometry(conical_tree.trunk)
point = Point(sub_list.List)
tree_canopy = Geometry(conical_tree.result)
number = Number(list_length_2)
vector_2pt = Vector2Pt(PointA="0,0,0", PointB=point, Unitize=False)  # -> Vector, Length
vector_2pt_2 = Vector2Pt(PointA="0,0,0", PointB=point, Unitize=False)  # -> Vector, Length
move = Move(Geometry=tree_trunk, Motion=vector_2pt.Vector)  # -> Geometry, Transform
move_2 = Move(Geometry=tree_canopy, Motion=vector_2pt_2.Vector)  # -> Geometry, Transform
random_2 = Random(Range="0.5 To 1.0", Number=number, Seed=2)
scale_2 = Scale(Geometry=move_2.Geometry, Center=point, Factor=random_2)  # -> Geometry, Transform

# ---- group: color and size gradient
trunk_color_2 = ColourSwatch(SwatchColor=RGB(139, 76, 57))
canopy_color_2 = ColourSwatch(SwatchColor=RGBA(58, 94, 58, 232))
canopy_color_3 = ColourSwatch(SwatchColor=RGBA(64, 128, 117, 232))
canopy_color_4 = ColourSwatch(SwatchColor=RGBA(123, 128, 64, 232))
range = Range(Domain=Domain(0, 1), Steps=expr("x-1", number))
colour = Colour([canopy_color_2, canopy_color_3, canopy_color_4])
graph_mapper = GraphMapper(
    range,
    x0=0,
    x1=1,
    y0=0,
    y1=1,
    container_name="Bezier",
    cpx=[0, 0.4082066715, 0.590077281, 1],
    cpy=[1, 0.7487925291, 0.6408074498, 0.6039702892])
interpolate_data = InterpolateData(Data=colour, Parameter=range, Interpolation=2)
scale_3 = Scale(Geometry=scale_2.Geometry, Center=point, Factor=graph_mapper)  # -> Geometry, Transform
custom_preview_3 = CustomPreview(Geometry=move.Geometry, Material=trunk_color_2)
custom_preview_4 = CustomPreview(Geometry=scale_3.Geometry, Material=interpolate_data)

# ==== cluster ConicalTree
factor = ClusterInput()
factor_2 = ClusterInput()
A = ClusterInput()
A_2 = ClusterInput()

# ---- group: conical tree
construct_point = ConstructPoint(XCoordinate=0, YCoordinate=0, ZCoordinate=0)
unit_z = UnitZ(Factor=factor)
unit_z_2 = UnitZ(Factor=factor_2)
division = Division(A=A, B="2.0")
division_2 = Division(A=A_2, B="2.0")
B = ClusterInput()
move = Move(Geometry=construct_point, Motion=unit_z_2)  # -> Geometry, Transform
move_2 = Move(Geometry=construct_point, Motion=unit_z)  # -> Geometry, Transform
division_3 = Division(A=unit_z_2, B=B)
line = Line(StartPoint=construct_point, EndPoint=move_2.Geometry)
line_2 = Line(StartPoint=move_2.Geometry, EndPoint=move.Geometry)
divide_distance = DivideDistance(Curve=line_2, Distance=division_3)  # -> Points, Tangents, Parameters
construct_plane = ConstructPlane(Origin=divide_distance.Points, XAxis=Vector(1, 0, 0), YAxis=Vector(0, 1, 0))
construct_domain = ConstructDomain(DomainStart="0.5", DomainEnd="1.75")
cone = Cone(Base=construct_plane, Radius=division_2, Length=division_3)  # -> Cone, Tip
list_length = ListLength(List=construct_plane)
range = Range(Domain=construct_domain, Steps=list_length)  # -> reverse(Range)
scale = Scale(Geometry=cone.Cone, Center=construct_plane, Factor=range)  # -> Geometry, Transform
pipe = Pipe(Curve=line, Radius=division, Caps=0)
cap_holes = CapHoles(Brep=scale.Geometry)
solid_union = SolidUnion(Breps=cap_holes)

# ----
trunk = ClusterOutput(pipe)
result = ClusterOutput(solid_union)
