# Grasshopper definition fundamentals.gh (Grasshopper 1.0.7)
# Copyright: GNU General Public License 3.0

X = Slider(2, range=0..10)
Y = Slider(2, range=0..10)
Z = Slider(0, range=0..10)
construct_point = ConstructPoint(XCoordinate=X, YCoordinate=Y, ZCoordinate=Z)
point = Point(construct_point)

count = Slider(25, range=0..100)
seed = Slider(0, range=0..100)
populate_3d = Populate3D(Region={Plane=PlaneXY(0, 0, 0), X=Domain(0, 10), Y=Domain(0, 10), Z=Domain(0, 2)}, Count=count, Seed=seed)
point_2 = Point(populate_3d)

# ----
# curves
count_2 = Slider(6, range=0..10)
seed_2 = Slider(0, range=0..100)
populate_3d_2 = Populate3D(Region={Plane=PlaneXY(0, 0, 0), X=Domain(0, 10), Y=Domain(0, 10), Z=Domain(0, 2)}, Count=count_2, Seed=seed_2)
interpolate = Interpolate(Vertices=populate_3d_2, Degree=3, Periodic=False, KnotStyle=1)  # -> Curve, Length, Domain
curve = Curve(interpolate.Curve)

# ---- group: mesh from random points
# meshes
count_3 = Slider(12, range=3..100)
seed_3 = Slider(1, range=0..100)
populate_3d_3 = Populate3D(Region={Plane=PlaneXY(0, 0, 0), X=Domain(0, 10), Y=Domain(0, 10), Z=Domain(0, 2)}, Count=count_3, Seed=seed_3)
delaunay_mesh = DelaunayMesh(Points=populate_3d_3, Plane=PlaneXY(0, 0, 0))
mesh = Mesh(delaunay_mesh)

# ---- group: surface from random points
# surfaces
number = Slider(12, range=3..100)
seed_4 = Slider(0, range=0..100)
# boundary representation
spans = Slider(20, range=0..100)
populate_3d_4 = Populate3D(Region={Plane=PlaneXY(0, 0, 0), X=Domain(0, 10), Y=Domain(0, 10), Z=Domain(0, 2)}, Count=number, Seed=seed_4)
patch = Patch(Points=populate_3d_4, Spans=spans, Flexibility=1, Trim=True)
surface = Surface(patch)

# ----
surface_2 = Surface(surface)
Z_2 = Slider(1, range=0..2)
unit_z = UnitZ(Factor=Z_2)
extrude = Extrude(Base=surface_2, Direction=unit_z)
brep = Brep(extrude)

# ----
# vector
xy_plane = XYPlane(Origin=Point(0, 0, 0))
unit_x = UnitX(Factor=1)
vector_display = VectorDisplay(Anchor=xy_plane, Vector=unit_x)
panel = Panel(unit_x)

xy_plane_2 = XYPlane(Origin=Point(0, 0, 0))
X_2 = Slider(2, range=0..10)
Y_2 = Slider(2, range=0..10)
Z_3 = Slider(0, range=0..10)
vector_xyz = VectorXYZ(XComponent=X_2, YComponent=Y_2, ZComponent=Z_3)  # -> Vector, Length
vector_display_2 = VectorDisplay(Anchor=xy_plane_2, Vector=vector_xyz.Vector)
panel_2 = Panel(vector_xyz.Length)

xy_plane_3 = XYPlane(Origin=Point(0, 0, 0))
count_4 = Slider(12, range=3..100)
seed_5 = Slider(1, range=0..100)
populate_3d_5 = Populate3D(Region={Plane=PlaneXY(0, 0, 0), X=Domain(0, 10), Y=Domain(0, 10), Z=Domain(0, 2)}, Count=count_4, Seed=seed_5)
vector_2pt = Vector2Pt(PointA=xy_plane_3, PointB=populate_3d_5, Unitize=False)  # -> Vector, Length
vector_display_3 = VectorDisplay(Anchor=xy_plane_3, Vector=vector_2pt.Vector)

# ---- group: right click to set one point
# fundamentals
# geometry
# points
point_3 = Point(Point(0, 0, 0))

# ----
panel_3 = Panel(vector_xyz.Vector)

# ----
# transformations
# translation
dimensions = Slider(1, range=0..10)
X_3 = Slider(4, range=0..10)
center_box = CenterBox(Base=PlaneXY(0, 0, 0), X=dimensions, Y=dimensions, Z=dimensions)
unit_x_2 = UnitX(Factor=X_3)
move = Move(Geometry=center_box, Motion=unit_x_2)  # -> Geometry, Transform
box = Box(move.Geometry)

# ----
# rotation
box_2 = Box(box)
radians = Slider(0.25, range=0..1)
area = Area(Geometry=box_2)  # -> Area, Centroid
pi = Pi(Factor=radians)
rotate = Rotate(Geometry=box_2, Angle=pi, Plane=area.Centroid)  # -> Geometry, Transform
box_3 = Box(rotate.Geometry)

box_4 = Box(box)
degrees = Slider(45, range=0..100)
area_2 = Area(Geometry=box_4)  # -> Area, Centroid
rotate_2 = Rotate(Geometry=box_4, Angle=degrees(degrees), Plane=area_2.Centroid)  # -> Geometry, Transform
box_5 = Box(rotate_2.Geometry)

# ----
# scaling
box_6 = Box(box_3)
scale = Slider(1.5, range=0..3)
area_3 = Area(Geometry=box_6)  # -> Area, Centroid
scale_2 = Scale(Geometry=box_6, Center=area_3.Centroid, Factor=scale)  # -> Geometry, Transform
box_7 = Box(scale_2.Geometry)

# ----
# data types
# text
panel_4 = Panel("hello world")
text = Text(panel_4)
panel_5 = Panel(text)

# ----
# numbers
float = Slider(2.25, range=0..10)
# booleans
integer = Slider(2, range=0..10)
number_2 = Number(float)
integer_2 = Integer(integer)
panel_6 = Panel(number_2)
panel_7 = Panel(integer_2)

# ----
# lists
boolean_toggle = BooleanToggle(False)
boolean = Boolean(boolean_toggle)
panel_8 = Panel(boolean)

count_5 = Slider(5, range=0..10)
series = Series(Start=0, Step=1, Count=count_5)
panel_9 = Panel(series)

count_6 = Slider(4, range=0..10)
# data trees
seed_6 = Slider(0, range=0..100)
populate_3d_6 = Populate3D(Region={Plane=PlaneXY(0, 0, 0), X=Domain(0, 10), Y=Domain(0, 10), Z=Domain(0, 2)}, Count=count_6, Seed=seed_6)
panel_10 = Panel(populate_3d_6)

start = Slider(1, range=0..10)
count_7 = Slider(4, range=0..10)
series_2 = Series(Start=start, Step=1, Count=count_7)
series_3 = Series(Start=0, Step=1, Count=series_2)
panel_11 = Panel(series_3)
param_viewer = ParamViewer(panel_11)
param_viewer_2 = ParamViewer(panel_11)

# ----
# flattening
panel_12 = Panel(series_3)
number_3 = Number(flatten(panel_12))
panel_13 = Panel(number_3)
param_viewer_3 = ParamViewer(panel_13)
param_viewer_4 = ParamViewer(panel_13)

# ----
# grafting
panel_14 = Panel(series_2)
number_4 = Number(graft(panel_14))
panel_15 = Panel(number_4)
param_viewer_5 = ParamViewer(panel_15)
param_viewer_6 = ParamViewer(panel_15)

# ----
# list management
# culling pattern
count_8 = Slider(5, range=0..10)
# dispatch
boolean_toggle_2 = BooleanToggle(False)
relay = Relay([Toggle(True), boolean_toggle_2])
series_4 = Series(Start=0, Step=1, Count=count_8)
cull_pattern = CullPattern(List=series_4, CullPattern=relay)
panel_16 = Panel(series_4)
panel_17 = Panel(cull_pattern)

count_9 = Slider(5, range=0..10)
boolean_toggle_3 = BooleanToggle(True)
boolean_toggle_4 = BooleanToggle(False)
series_5 = Series(Start=0, Step=1, Count=count_9)
dispatch = Dispatch(List=series_5, DispatchPattern=[boolean_toggle_3, boolean_toggle_4])  # -> ListA, ListB
list_a = Number(dispatch.ListA)
list_b = Number(dispatch.ListB)
panel_18 = Panel(series_5)
panel_19 = Panel(list_a)
panel_20 = Panel(list_b)

# ----
# weave
boolean_2 = Boolean(invert([boolean_toggle_3, boolean_toggle_4]))
list_a_2 = Number(list_a)
list_b_2 = Number(list_b)
negative = Negative(Value=list_b_2)
weave = Weave(Pattern=boolean_2, Stream0=list_a_2, Stream1=negative, NullGaps=False)
number_5 = Number(weave)
panel_21 = Panel(number_5)

count_10 = Slider(10, range=0..100)
range = Range(Domain=Domain(0, 1), Steps=count_10)
dispatch_2 = Dispatch(List=range, DispatchPattern=[True, False])  # -> ListA, ListB
negative_2 = Negative(Value=dispatch_2.ListB)
mass_addition = MassAddition(Input=range)  # -> Result, PartialResults
weave_2 = Weave(Pattern=[0, 1], Stream0=dispatch_2.ListA, Stream1=negative_2, NullGaps=False)
construct_point_2 = ConstructPoint(XCoordinate=mass_addition.PartialResults, YCoordinate=0, ZCoordinate=weave_2)
interpolate_2 = Interpolate(Vertices=construct_point_2, Degree=3, Periodic=False, KnotStyle=1)  # -> Curve, Length, Domain
curve_2 = Curve(interpolate_2.Curve)

count_11 = Panel(count_10)
range_2 = Panel(range)
list_a_3 = Panel(dispatch_2.ListA)
list_b_3 = Panel(dispatch_2.ListB)
list_b_4 = Panel(negative_2)
weave_3 = Panel(weave_2)
point_4 = Panel(construct_point_2)
curve_3 = Panel(interpolate_2.Curve)

# ----
# display
# custom preview
point_5 = Point(point_2)
size = Slider(0.25, range=0..1)
cloud_display = CloudDisplay(Points=point_5, Colours=ColourSwatch(SwatchColor=RGB(38, 38, 38)), Size=size, SpriteType=1)

curve_4 = Curve(curve)
custom_preview = CustomPreview(Geometry=curve_4, Material=ColourSwatch(SwatchColor=RGB(51, 51, 51)))

mesh_2 = Mesh(mesh)
mesh_edges = MeshEdges(Mesh=mesh_2)  # -> NakedEdges, InteriorEdges, NonManifoldEdges
custom_preview_2 = CustomPreview(Geometry=mesh_2, Material=ColourSwatch(SwatchColor=RGB(204, 204, 204)))
custom_preview_3 = CustomPreview(Geometry=[mesh_edges.NakedEdges, mesh_edges.InteriorEdges], Material=ColourSwatch(SwatchColor=RGB(51, 51, 51)))

surface_3 = Surface(surface)
custom_preview_4 = CustomPreview(Geometry=surface_3, Material=ColourSwatch(SwatchColor=RGB(204, 204, 204)))

brep_2 = Brep(brep)
custom_preview_5 = CustomPreview(Geometry=brep_2, Material=ColourSwatch(SwatchColor=RGB(204, 204, 204)))

box_8 = Box(center_box)
custom_preview_6 = CustomPreview(Geometry=box_8, Material=ColourSwatch(SwatchColor=RGB(204, 204, 204)))

box_9 = Box(box_7)
custom_preview_7 = CustomPreview(Geometry=box_9, Material=ColourSwatch(SwatchColor=RGB(51, 51, 51)))
