# Grasshopper definition lungomare-bench.gh (Grasshopper 1.0.7)

# ---- group: sine waves
# lungomare bench
# from trigonmetric functions
initial_frequency = Slider(1, range=0..10)
frequency = Slider(3, range=0..10)
steps = Slider(4, range=0..10)
start = Slider(0.6, range=0..1)
amplitude = Slider(0.36, range=0..1)
count = Slider(4, range=0..10)
pi = Pi(Factor=initial_frequency)
pi_2 = Pi(Factor=frequency)
series = Series(Start=start, Step=amplitude, Count=count)
construct_domain = ConstructDomain(DomainStart=pi, DomainEnd=pi_2)
range = Range(Domain=construct_domain, Steps=steps)
multiplication = Multiplication(A=range, B=graft(series))
sine = Sine(Value=multiplication)
construct_point = ConstructPoint(XCoordinate=range, YCoordinate=0, ZCoordinate=sine)
interpolate = Interpolate(Vertices=construct_point, Degree=3, Periodic=False, KnotStyle=1)  # -> Curve, Length, Domain
curve = Curve(interpolate.Curve)

# ---- group: loft
curve_2 = Curve(curve)
y_distance = Slider(2, range=0..100)
count_2 = Number(count)
depth = Slider(0.5, range=0..1)
series_2 = Series(Start=0, Step=y_distance, Count=count_2)
unit_y = UnitY(Factor=series_2)
move = Move(Geometry=flatten(curve_2), Motion=unit_y)  # -> Geometry, Transform
unit_z = UnitZ(Factor=depth)
loft = Loft(Curves=move.Geometry, Options={Adjust=False, Closed=False, LoftEnds=0, LoftSimp=0, LoftType=0, Rebuild=10, Refit=0.01})
extrude = Extrude(Base=loft, Direction=unit_z)
custom_preview = CustomPreview(Geometry=extrude, Material=ColourSwatch(SwatchColor=RGB(204, 204, 204)))

# ---- group: random sine waves
# from randomized trigonmetric functions
initial_frequency_2 = Slider(1, range=0..10)
frequency_2 = Slider(3, range=0..10)
steps_2 = Slider(4, range=0..10)
count_3 = Slider(4, range=0..10)
seed = Slider(4, range=0..100)
pi_3 = Pi(Factor=initial_frequency_2)
pi_4 = Pi(Factor=frequency_2)
construct_domain_2 = ConstructDomain(DomainStart=pi_3, DomainEnd=pi_4)
random = Random(Range="0.5 to 1.5", Number=count_3, Seed=seed)
range_2 = Range(Domain=construct_domain_2, Steps=steps_2)
multiplication_2 = Multiplication(A=range_2, B=graft(random))
sine_2 = Sine(Value=multiplication_2)
construct_point_2 = ConstructPoint(XCoordinate=range_2, YCoordinate=0, ZCoordinate=sine_2)
interpolate_2 = Interpolate(Vertices=construct_point_2, Degree=3, Periodic=False, KnotStyle=1)  # -> Curve, Length, Domain
curve_3 = Curve(interpolate_2.Curve)

# ---- group: loft
curve_4 = Curve(curve_3)
y_distance_2 = Slider(2, range=0..100)
count_4 = Number(count)
depth_2 = Slider(0.5, range=0..1)
series_3 = Series(Start=0, Step=y_distance_2, Count=count_4)
unit_y_2 = UnitY(Factor=series_3)
move_2 = Move(Geometry=flatten(curve_4), Motion=unit_y_2)  # -> Geometry, Transform
unit_z_2 = UnitZ(Factor=depth_2)
loft_2 = Loft(Curves=move_2.Geometry, Options={Adjust=False, Closed=False, LoftEnds=0, LoftSimp=0, LoftType=0, Rebuild=10, Refit=0.01})
extrude_2 = Extrude(Base=loft_2, Direction=unit_z_2)
custom_preview_2 = CustomPreview(Geometry=extrude_2, Material=ColourSwatch(SwatchColor=RGB(204, 204, 204)))

# ---- group: sets of random sine waves
# design matrix
initial_frequency_3 = Slider(1, range=0..10)
frequency_3 = Slider(4, range=0..10)
steps_3 = Slider(4, range=0..10)
count_5 = Slider(4, range=0..10)
seed_range = Slider(1000, range=0..1000)
designs = Slider(24, range=0..100)
seed_2 = Slider(0, range=0..100)
pi_5 = Pi(Factor=initial_frequency_3)
pi_6 = Pi(Factor=frequency_3)
random_2 = Random(Range=seed_range, Number=designs, Seed=seed_2)
construct_domain_3 = ConstructDomain(DomainStart=pi_5, DomainEnd=pi_6)
random_3 = Random(Range="0.5 to 1.5", Number=count_5, Seed=random_2)
range_3 = Range(Domain=construct_domain_3, Steps=steps_3)
multiplication_3 = Multiplication(A=range_3, B=graft(random_3))
sine_3 = Sine(Value=multiplication_3)
construct_point_3 = ConstructPoint(XCoordinate=range_3, YCoordinate=0, ZCoordinate=sine_3)
interpolate_3 = Interpolate(Vertices=construct_point_3, Degree=3, Periodic=False, KnotStyle=1)  # -> Curve, Length, Domain
curve_5 = Curve(flatten(interpolate_3.Curve))

# ---- group: loft each set of curves
curve_6 = Curve(curve_5)
count_6 = Number(count_5)
y_distance_3 = Slider(2, range=0..100)
depth_3 = Slider(0.5, range=0..1)
series_4 = Series(Start=0, Step=y_distance_3, Count=count_6)
partition_list = PartitionList(List=curve_6, Size=count_6)
unit_y_3 = UnitY(Factor=series_4)
move_3 = Move(Geometry=partition_list, Motion=unit_y_3)  # -> Geometry, Transform
unit_z_3 = UnitZ(Factor=depth_3)
loft_3 = Loft(Curves=move_3.Geometry, Options={Adjust=False, Closed=False, LoftEnds=0, LoftSimp=0, LoftType=0, Rebuild=10, Refit=0.01})
extrude_3 = Extrude(Base=loft_3, Direction=unit_z_3)  # -> flatten(Extrusion)
brep = Brep(extrude_3)

# ---- group: distribute across grid
brep_2 = Brep(brep)
spacing = Slider(11, range=0..25)
designs_2 = Number(designs)
square_root = SquareRoot(Value=designs_2)
subtraction = Subtraction(A=square_root, B="1")
square = Square(Plane=PlaneXY(0, 0, 0), Size=spacing, ExtentX=subtraction, ExtentY=subtraction)  # -> Cells, flatten(Points)
vector_2pt = Vector2Pt(PointA="0,0,0", PointB=square.Points, Unitize=False)  # -> Vector, Length
move_4 = Move(Geometry=brep_2, Motion=vector_2pt.Vector)  # -> Geometry, Transform
custom_preview_3 = CustomPreview(Geometry=move_4.Geometry, Material=ColourSwatch(SwatchColor=RGB(209, 209, 209)))
