# Grasshopper definition noisescape.gh (Grasshopper 1.0.7)
# plug-ins: Pufferfish, Noise 4D

# ---- group: simplex noise field
time = Slider(3, range=0..100)
scale = Slider(0.08, range=0..1)
# terrain from noise
extent = Slider(40, range=0..100)
amplitude = Slider(5, range=0..10)
square = Square(Plane=PlaneXY(0, 0, 0), Size=1, ExtentX=extent, ExtentY=extent)  # -> Cells, flatten(Points)
# using 4D noise
simplexnoise = SimplexNoise(Values=square.Points, Time=time, Scale=scale)
multiplication = Multiplication(A=simplexnoise, B=amplitude)
unit_z = UnitZ(Factor=multiplication)
bounding_rectangle = BoundingRectangle(Geometry=flatten(square.Cells), Plane=PlaneXY(0, 0, 0), Axis=0, Slide=0, Union=True)  # -> Bounding, DimensionX, DimensionY
move = Move(Geometry=square.Points, Motion=unit_z)  # -> Geometry, Transform
patch = Patch(Curves=bounding_rectangle.Bounding, Points=move.Geometry, Spans=20, Flexibility=1, Trim=True)
custom_preview = CustomPreview(Geometry=patch, Material=ColourSwatch(SwatchColor=RGB(219, 219, 219)))

# ---- group: perlin noise field
time_2 = Slider(36, range=0..100)
scale_2 = Slider(0.15, range=0..1)
amplitude_2 = Slider(8, range=0..10)
extent_2 = Slider(40, range=0..100)
square_2 = Square(Plane=PlaneXY(0, 0, 0), Size=1, ExtentX=extent_2, ExtentY=extent_2)  # -> Cells, flatten(Points)
# using 4D noise
perlinnoise = PerlinNoise(Values=square_2.Points, Time=time_2, Scale=scale_2)
multiplication_2 = Multiplication(A=perlinnoise, B=amplitude_2)
unit_z_2 = UnitZ(Factor=multiplication_2)
bounding_rectangle_2 = BoundingRectangle(Geometry=flatten(square_2.Cells), Plane=PlaneXY(0, 0, 0), Axis=0, Slide=0, Union=True)  # -> Bounding, DimensionX, DimensionY
move_2 = Move(Geometry=square_2.Points, Motion=unit_z_2)  # -> Geometry, Transform
patch_2 = Patch(Curves=bounding_rectangle_2.Bounding, Points=move_2.Geometry, Spans=20, Flexibility=1, Trim=True)
custom_preview_2 = CustomPreview(Geometry=patch_2, Material=ColourSwatch(SwatchColor=RGB(219, 219, 219)))

# ---- group: contours
# visualization
surface = Surface(patch)
interval = Slider(0.25, range=0..2)
contour = Contour(Shape=surface, Point=Point(0, 0, 0), Direction=Vector(0, 0, 1), Distance=interval)
custom_preview_3 = CustomPreview(Geometry=contour, Material=ColourSwatch(SwatchColor=RGB(38, 38, 38)))

surface_2 = Surface(patch_2)
interval_2 = Slider(0.25, range=0..2)
contour_2 = Contour(Shape=surface_2, Point=Point(0, 0, 0), Direction=Vector(0, 0, 1), Distance=interval_2)
custom_preview_4 = CustomPreview(Geometry=contour_2, Material=ColourSwatch(SwatchColor=RGB(38, 38, 38)))

# ---- group: cutting plane
surface_3 = Surface(patch)
water_depth = Slider(1.2, range=0..10)
bounding_rectangle_3 = BoundingRectangle(Geometry=surface_3, Plane=PlaneXY(0, 0, 0), Axis=0, Slide=0, Union=True)  # -> Bounding, DimensionX, DimensionY
unit_z_3 = UnitZ(Factor=water_depth)
boundary_surfaces = BoundarySurfaces(Edges=bounding_rectangle_3.Bounding)
move_3 = Move(Geometry=boundary_surfaces, Motion=unit_z_3)  # -> Geometry, Transform
custom_preview_5 = CustomPreview(Geometry=move_3.Geometry, Material=ColourSwatch(SwatchColor=RGB(0, 0, 0)))

surface_4 = Surface(patch)
water_depth_2 = Slider(1, range=0..10)
bounding_rectangle_4 = BoundingRectangle(Geometry=surface_4, Plane=PlaneXY(0, 0, 0), Axis=0, Slide=0, Union=True)  # -> Bounding, DimensionX, DimensionY
unit_z_4 = UnitZ(Factor=water_depth_2)
boundary_surfaces_2 = BoundarySurfaces(Edges=bounding_rectangle_4.Bounding)
move_4 = Move(Geometry=boundary_surfaces_2, Motion=unit_z_4)  # -> Geometry, Transform
custom_preview_6 = CustomPreview(Geometry=move_4.Geometry, Material=ColourSwatch(SwatchColor=RGB(0, 0, 0)))
