# Grasshopper definition parametric-bench.gh (Grasshopper 1.0.7)
# Copyright: GNU General Public License 3.0

# ---- group: surface from interpolated curves
# parametric bench
point = Point(Point(0, 0, 0))
point_2 = Point(Point(0, 4.192741558, 1.359013339))
point_3 = Point(Point(0, 10.08962694, -1.082757608))
point_4 = Point(Point(0, 14.32175673, 0))
point_5 = Point(Point(0, 24, 0))
point_6 = Point(Point(0, 40.0280156, 0))
point_7 = Point(Point(2.624243035, 0, 0))
point_8 = Point(Point(5.092306532, 4.192741558, 0.3486026986))
point_9 = Point(Point(8.105550143, 14.05617472, 2.073408295))
point_10 = Point(Point(6.008178088, 20.31131201, 0.3200172636))
point_11 = Point(Point(3.59083715, 27.6912124, 0))
point_12 = Point(Point(3.000908326, 39.99856038, 0))
interpolate = Interpolate(Vertices=[point, point_2, point_3, point_4, point_5, point_6], Degree=3, Periodic=False, KnotStyle=1)  # -> Curve, Length, Domain
interpolate_2 = Interpolate(Vertices=[point_7, point_8, point_9, point_10, point_11, point_12], Degree=3, Periodic=False, KnotStyle=1)  # -> Curve, Length, Domain
ruled_surface = RuledSurface(CurveA=interpolate.Curve, CurveB=interpolate_2.Curve)

# ---- group: extrude surface as bench seat
brep = Brep(ruled_surface)
thickness = Slider(0.5, range=0..2)
height = Slider(3, range=0..10)
unit_z = UnitZ(Factor=thickness)
extrude = Extrude(Base=brep, Direction=unit_z)
unit_z_2 = UnitZ(Factor=height)
move = Move(Geometry=extrude, Motion=unit_z_2)  # -> Geometry, Transform
seat = Brep(move.Geometry)

# ---- group: model bench legs
start_a = Point(point)
end_a = Point(point_6)
start_b = Point(point_7)
end_b = Point(point_12)
thickness_2 = Number(thickness)
height_2 = Number(height)
multiplication = Multiplication(A=thickness_2, B="0.95")
negative = Negative(Value=thickness_2)
line = Line(StartPoint=start_a, EndPoint=start_b)
line_2 = Line(StartPoint=end_a, EndPoint=end_b)
addition = Addition(A=multiplication, B=height_2)
unit_z_3 = UnitZ(Factor=addition)
relay = Relay([line, line_2])
extrude_2 = Extrude(Base=relay, Direction=unit_z_3)
unit_y = UnitY(Factor=[thickness_2, negative])
extrude_3 = Extrude(Base=extrude_2, Direction=unit_y)
legs = Brep(extrude_3)

# ---- group: rendering
solid_union = SolidUnion(Breps=[seat, legs])
custom_preview = CustomPreview(Geometry=solid_union, Material=ColourSwatch(SwatchColor=RGB(204, 204, 204)))
