# Grasshopper definition parametric-tree.gh (Grasshopper 1.0.7)
# Copyright: GNU General Public License 3.0

# ---- group: trunk
# parametric tree
panel = Panel("0,0,0")
trunk_height = Slider(5, range=0..100)
trunk_radius = Slider(0.5, range=0..1)
unit_z = UnitZ(Factor=trunk_height)
move = Move(Geometry=panel, Motion=unit_z)  # -> Geometry, Transform
line = Line(StartPoint=panel, EndPoint=move.Geometry)
pipe = Pipe(Curve=line, Radius=trunk_radius, Caps="1")
trunk = Brep(pipe)

# ----
top_of_trunk = Point(move.Geometry)
tree_height = Slider(20, range=0..100)
trunk_height_2 = Number(trunk_height)
divisions = Slider(3, range=3..10)
canopy_radius = Slider(5, range=0..10)
subtraction = Subtraction(A=tree_height, B=trunk_height_2)
unit_z_2 = UnitZ(Factor=subtraction)
division = Division(A=subtraction, B=divisions)
move_2 = Move(Geometry=top_of_trunk, Motion=unit_z_2)  # -> Geometry, Transform
line_2 = Line(StartPoint=top_of_trunk, EndPoint=move_2.Geometry)
divide_curve = DivideCurve(Curve=line_2, Count=divisions, Kinks=False)  # -> Points, Tangents, Parameters
split_list = SplitList(List=divide_curve.Points, Index=divisions)  # -> ListA, ListB
range = Range(Domain="1 To 0.5", Steps=expr("x-1", divisions))
cone = Cone(Base=split_list.ListA, Radius=canopy_radius, Length=division)  # -> Cone, Tip
scale_nu = ScaleNU(Geometry=cone.Cone, Plane=split_list.ListA, ScaleX=range, ScaleY=range, ScaleZ=expr("x*2", range))  # -> Geometry, Transform
cap_holes = CapHoles(Brep=scale_nu.Geometry)
solid_union = SolidUnion(Breps=cap_holes)
canopy = Brep(solid_union)

# ---- group: tree cluster
# cluster
trunk_height_3 = Slider(5, range=0..100)
trunk_radius_2 = Slider(0.5, range=0..1)
tree_height_2 = Slider(20, range=0..100)
divisions_2 = Slider(3, range=0..10)
canopy_radius_2 = Slider(5, range=0..10)
conical_tree = ConicalTree(trunk_height=trunk_height_3, relay=trunk_radius_2, A=tree_height_2, relay_2=divisions_2, relay_3=canopy_radius_2)  # -> pipe_2, result
canopy_color = ColourSwatch(SwatchColor=RGBA(58, 94, 84, 232))
trunk_color = ColourSwatch(SwatchColor=RGB(139, 76, 57))
custom_preview = CustomPreview(Geometry=conical_tree.pipe_2, Material=trunk_color)
custom_preview_2 = CustomPreview(Geometry=conical_tree.result, Material=canopy_color)

# ==== cluster ConicalTree
trunk_height = ClusterInput()
relay = ClusterInput()
A = ClusterInput()
relay_2 = ClusterInput()
relay_3 = ClusterInput()
unit_z = UnitZ(Factor=trunk_height)
subtraction = Subtraction(A=A, B=trunk_height)
move = Move(Geometry="0,0,0", Motion=unit_z)  # -> Geometry, Transform
top_of_trunk = Point(move.Geometry)
unit_z_2 = UnitZ(Factor=subtraction)
division = Division(A=subtraction, B=relay_2)
move_2 = Move(Geometry=top_of_trunk, Motion=unit_z_2)  # -> Geometry, Transform
line = Line(StartPoint="0,0,0", EndPoint=move.Geometry)
line_2 = Line(StartPoint=top_of_trunk, EndPoint=move_2.Geometry)
pipe = Pipe(Curve=line, Radius=relay, Caps="1")
divide_curve = DivideCurve(Curve=line_2, Count=relay_2, Kinks=False)  # -> Points, Tangents, Parameters
pipe_2 = ClusterOutput(pipe)
split_list = SplitList(List=divide_curve.Points, Index=relay_2)  # -> ListA, ListB
range = Range(Domain="1 To 0.5", Steps=expr("x-1", relay_2))
cone = Cone(Base=split_list.ListA, Radius=relay_3, Length=division)  # -> Cone, Tip
multiplication = Multiplication(A=range, B="2")
scale_nu = ScaleNU(Geometry=cone.Cone, Plane=split_list.ListA, ScaleX=range, ScaleY=range, ScaleZ=multiplication)  # -> Geometry, Transform
cap_holes = CapHoles(Brep=scale_nu.Geometry)
solid_union = SolidUnion(Breps=cap_holes)
result = ClusterOutput(solid_union)
