# Grasshopper definition particle-forest.gh (Grasshopper 1.0.7)
# plug-ins: Pufferfish, Kangaroo2 Components

# ---- group: conifer
canopy_divisions = Slider(3, range=0..36)
trunk_height = Slider(8, range=0..36)
tree_height = Slider(30, range=0..36)
canopy_diameter = Slider(17, range=0..36)
# parametric tree
trunk_diameter = Slider(1.5, range=0..3)
conifer = Conifer(
    relay=trunk_diameter,
    factor=trunk_height,
    factor_2=tree_height,
    A=canopy_diameter,
    A_2=tree_height,
    B=canopy_divisions,
    steps=canopy_divisions)  # -> pipe_2, result
canopy_color = ColourSwatch(SwatchColor=RGBA(58, 94, 78, 232))
trunk_color = ColourSwatch(SwatchColor=RGB(139, 76, 57))
custom_preview = CustomPreview(Geometry=conifer.pipe_2, Material=trunk_color)
custom_preview_2 = CustomPreview(Geometry=conifer.result, Material=canopy_color)

# ---- group: particle system
# particle system
# run program
reset = BooleanToggle(False)
play = BooleanToggle(False)

radius = Slider(36, range=0..64)
count = Slider(180, range=0..360)
iterations = Slider(10, range=0..64)
point = Point(Point(0, -0.005287529503, 0))
circle = Circle(Plane=PlaneXY(0, 0, 0), Radius=radius)
boundary_surfaces = BoundarySurfaces(Edges=circle)
populate_geometry = PopulateGeometry(Geometry=boundary_surfaces, Count=count, Seed=1)
bomb = Bomb(Location=point, Points=populate_geometry, DetonationTime=1, Strength=1, Reset=reset)
curvepointcollide = CurvePointCollide(Points=populate_geometry, Curve=circle, Plane=PlaneXY(0, 0, 0), Interior=True, Strength=1)
spherecollide = SphereCollide(Points=populate_geometry, Radius=1, Strength=1)
bouncysolver = BouncySolver(
    GoalObjects=[curvepointcollide, bomb, spherecollide],
    Reset=reset,
    Threshold=1e-15,
    Tolerance=0.01,
    Damping=0.99,
    Iterations=iterations,
    On=play)  # -> I, V, O
cloud_display = CloudDisplay(Points=bouncysolver.V, Colours=ColourSwatch(SwatchColor=RGB(255, 255, 255)), Size=0.5, SpriteType=0)

# ---- group: forest from particle system
scale = Slider(3, range=0..100)
canopies = Geometry(conifer.result)
particles = Geometry(bouncysolver.V)
proportion = Slider(0.5, range=0..1)
# forest
trunks = Geometry(conifer.pipe_2)
scale_2 = Scale(Geometry=particles, Center=Point(0, 0, 0), Factor=scale)  # -> Geometry, Transform
origin = Panel("0,0,0")
list_length = ListLength(List=scale_2.Geometry)
move_to_point = MoveToPoint(Geometry=trunks, PointA=origin, PointB=scale_2.Geometry)  # -> Moved, Vector, Transform
move_to_point_2 = MoveToPoint(Geometry=canopies, PointA=origin, PointB=scale_2.Geometry)  # -> Moved, Vector, Transform
multiplication = Multiplication(A=list_length, B=proportion)
range = Range(Domain="0.5 To 1", Steps=expr("x-1", list_length))
scale_3 = Scale(Geometry=move_to_point_2.Moved, Center=move_to_point_2.Vector, Factor=range)  # -> Geometry, Transform
split_list = SplitList(List=scale_3.Geometry, Index=multiplication)  # -> ListA, ListB
trunk_color_2 = ColourSwatch(SwatchColor=RGB(139, 76, 57))
canopy_color_2 = ColourSwatch(SwatchColor=RGBA(80, 135, 110, 232))
canopy_color_3 = ColourSwatch(SwatchColor=RGBA(58, 94, 78, 232))
custom_preview_3 = CustomPreview(Geometry=move_to_point.Moved, Material=trunk_color_2)
custom_preview_4 = CustomPreview(Geometry=split_list.ListA, Material=canopy_color_2)
custom_preview_5 = CustomPreview(Geometry=split_list.ListB, Material=canopy_color_3)

# ==== cluster Conifer
factor = ClusterInput()
factor_2 = ClusterInput()
A = ClusterInput()
A_2 = ClusterInput()
B = ClusterInput()
unit_z = UnitZ(Factor=factor)
construct_point = ConstructPoint(XCoordinate=0, YCoordinate=0, ZCoordinate=0)
unit_z_2 = UnitZ(Factor=factor_2)
division = Division(A=A, B=4)
division_2 = Division(A=A_2, B=B)
move = Move(Geometry=construct_point, Motion=unit_z)  # -> Geometry, Transform
move_2 = Move(Geometry=construct_point, Motion=unit_z_2)  # -> Geometry, Transform
relay = ClusterInput()
line = Line(StartPoint=move.Geometry, EndPoint=move_2.Geometry)
line_2 = Line(StartPoint=construct_point, EndPoint=move.Geometry)
divide_distance = DivideDistance(Curve=line, Distance=division_2)  # -> Points, Tangents, Parameters
pipe = Pipe(Curve=line_2, Radius=expr("x/2", relay), Caps=1)
construct_domain = ConstructDomain(DomainStart="0.75", DomainEnd="2")
pipe_2 = ClusterOutput(pipe)
steps = ClusterInput()
range = Range(Domain=construct_domain, Steps=expr("x-1", steps))  # -> reverse(Range)
cone = Cone(Base=divide_distance.Points, Radius=division, Length=division_2)  # -> Cone, Tip
scale = Scale(Geometry=cone.Cone, Center=divide_distance.Points, Factor=range)  # -> Geometry, Transform
cap_holes = CapHoles(Brep=scale.Geometry)
solid_union = SolidUnion(Breps=cap_holes)
result = ClusterOutput(solid_union)
