# Grasshopper definition random-forest.gh (Grasshopper 1.0.7)

# ---- group: generate a conical tree
# tree
# diameter at breast height (DBH)
trunk_diameter = Slider(0.75, range=0..2)
trunk_height = Slider(8, range=0..100)
crown_height = Slider(30, range=0..75)
canopy_layers = Slider(3, range=0..10)
canopy_diameter = Slider(10, range=0..100)
conical_tree = ConicalTree(A=trunk_diameter, factor=trunk_height, factor_2=crown_height, B=canopy_layers, A_2=canopy_diameter)  # -> trunk, result
trunk_color = ColourSwatch(SwatchColor=RGB(139, 76, 57))
canopy_color = ColourSwatch(SwatchColor=RGBA(58, 94, 58, 232))
custom_preview = CustomPreview(Geometry=conical_tree.trunk, Material=trunk_color)
custom_preview_2 = CustomPreview(Geometry=conical_tree.result, Material=canopy_color)

# ---- group: populate a circular region
# metaregion
radius = Slider(100, range=0..360)
count = Slider(6, range=0..1000)
seed = Slider(43, range=0..1000)
circle = Circle(Plane=PlaneXY(0, 0, 0), Radius=radius)
boundary_surfaces = BoundarySurfaces(Edges=circle)
populate_geometry = PopulateGeometry(Geometry=boundary_surfaces, Count=count, Seed=seed)

# ---- group: populate regions with metaregion
# regions
point = Point(populate_geometry)
count_2 = Number(count)
seed_2 = Number(seed)
density = Slider(1.2, range=0..3)
seed_3 = Slider(0, range=0..1000)
random = Random(Range="25 To 75", Number=count_2, Seed=seed_2)
circle_2 = Circle(Plane=point, Radius=random)
boundary_surfaces_2 = BoundarySurfaces(Edges=circle_2)
multiplication = Multiplication(A=random, B=density)
populate_geometry_2 = PopulateGeometry(Geometry=boundary_surfaces_2, Count=multiplication, Seed=seed_3)
point_2 = Point(flatten(populate_geometry_2))

# ---- group: cull points by distance from center
# cull by distance
origins = Point(populate_geometry)
points = Point(point_2)
count_3 = Number(multiplication)
closest_points = ClosestPoints(Point=origins, Cloud=points, Count=count_3)  # -> ClosestPoint, CPIndex, Distance
range = Range(Domain=Domain(0, 1), Steps=expr("x-1", count_3))
random_2 = Random(Range=Domain(0, 1), Number=count_3, Seed=seed)
graph_mapper = GraphMapper(
    range,
    x0=0,
    x1=1,
    y0=0,
    y1=1,
    container_name="Bezier",
    cpx=[0, 0.3367159069, 0.8007264137, 1],
    cpy=[0, 0.8999996185, 0.1527468562, 0.9981682897])
smaller_than = SmallerThan(FirstNumber=graph_mapper, SecondNumber=random_2)  # -> SmallerThan, OrEqualTo
cull_pattern = CullPattern(List=closest_points.ClosestPoint, CullPattern=smaller_than.SmallerThan)
culled_points = Point(cull_pattern)

# ---- group: move and scale trees
# array
trunks = Geometry(conical_tree.trunk)
canopies = Geometry(conical_tree.result)
culled_points_2 = Point(culled_points)
list_length = ListLength(List=culled_points)
vector_2pt = Vector2Pt(PointA="0,0,0", PointB=culled_points_2, Unitize=False)  # -> Vector, Length
range_2 = Range(Domain="0.5 To 1.0", Steps=expr("x-1", list_length))  # -> reverse(Range)
graph_mapper_2 = GraphMapper(
    range_2,
    x0=0,
    x1=1,
    y0=0,
    y1=1,
    container_name="Bezier",
    cpx=[0, 0.3367159069, 0.8007264137, 1],
    cpy=[0, 0.8999996185, 0.1527468562, 0.9981682897])
move = Move(Geometry=canopies, Motion=vector_2pt.Vector)  # -> Geometry, Transform
move_2 = Move(Geometry=trunks, Motion=vector_2pt.Vector)  # -> Geometry, Transform
scale_nu = ScaleNU(Geometry=move_2.Geometry, Plane=vector_2pt.Vector, ScaleX=1, ScaleY=1, ScaleZ=graph_mapper_2)  # -> Geometry, Transform
scale = Scale(Geometry=move.Geometry, Center=vector_2pt.Vector, Factor=graph_mapper_2)  # -> Geometry, Transform

# ---- group: tree color
trunks_2 = Geometry(scale_nu.Geometry)
trunk_color_2 = ColourSwatch(SwatchColor=RGB(139, 76, 57))
canopy = Geometry(scale.Geometry)
canopy_color_2 = ColourSwatch(SwatchColor=RGBA(58, 94, 58, 232))
canopy_color_3 = ColourSwatch(SwatchColor=RGBA(64, 128, 117, 232))
canopy_color_4 = ColourSwatch(SwatchColor=RGBA(123, 128, 64, 232))
culled_count = Number(list_length)
colour = Colour([canopy_color_2, canopy_color_3, canopy_color_4])
range_3 = Range(Domain=Domain(0, 1), Steps=culled_count)
# color
interpolate_data = InterpolateData(Data=colour, Parameter=range_3, Interpolation=2)
custom_preview_3 = CustomPreview(Geometry=trunks_2, Material=trunk_color_2)
custom_preview_4 = CustomPreview(Geometry=canopy, Material=interpolate_data)

# ---- group: ground
surface = Surface(boundary_surfaces_2)
scale_2 = Slider(1.05, range=0..10)
depth = Slider(2, range=0..10)
scale_3 = Scale(Geometry=surface, Center=Point(0, 0, 0), Factor=scale_2)  # -> Geometry, Transform
negative = Negative(Value=depth)
unit_z = UnitZ(Factor=negative)
extrude = Extrude(Base=scale_3.Geometry, Direction=unit_z)
ground_color = ColourSwatch(SwatchColor=RGB(140, 123, 118))
custom_preview_5 = CustomPreview(Geometry=extrude, Material=ground_color)

# ==== cluster ConicalTree
factor = ClusterInput()
factor_2 = ClusterInput()
A = ClusterInput()
A_2 = ClusterInput()

# ---- group: conical tree
construct_point = ConstructPoint(XCoordinate=0, YCoordinate=0, ZCoordinate=0)
unit_z = UnitZ(Factor=factor)
unit_z_2 = UnitZ(Factor=factor_2)
division = Division(A=A, B="2.0")
division_2 = Division(A=A_2, B="2.0")
B = ClusterInput()
move = Move(Geometry=construct_point, Motion=unit_z_2)  # -> Geometry, Transform
move_2 = Move(Geometry=construct_point, Motion=unit_z)  # -> Geometry, Transform
division_3 = Division(A=unit_z_2, B=B)
line = Line(StartPoint=construct_point, EndPoint=move_2.Geometry)
line_2 = Line(StartPoint=move_2.Geometry, EndPoint=move.Geometry)
divide_distance = DivideDistance(Curve=line_2, Distance=division_3)  # -> Points, Tangents, Parameters
construct_plane = ConstructPlane(Origin=divide_distance.Points, XAxis=Vector(1, 0, 0), YAxis=Vector(0, 1, 0))
construct_domain = ConstructDomain(DomainStart="0.5", DomainEnd="1.75")
cone = Cone(Base=construct_plane, Radius=division_2, Length=division_3)  # -> Cone, Tip
list_length = ListLength(List=construct_plane)
range = Range(Domain=construct_domain, Steps=list_length)  # -> reverse(Range)
scale = Scale(Geometry=cone.Cone, Center=construct_plane, Factor=range)  # -> Geometry, Transform
pipe = Pipe(Curve=line, Radius=division, Caps=0)
cap_holes = CapHoles(Brep=scale.Geometry)
solid_union = SolidUnion(Breps=cap_holes)

# ----
trunk = ClusterOutput(pipe)
result = ClusterOutput(solid_union)
