# Grasshopper definition random-paving.gh (Grasshopper 1.0.7)
# Copyright: GNU General Public License 3.0

# ----
# random paving
# stacked bond
X = Slider(3, range=0..10)
Y = Slider(1, range=0..10)
extent_x = Slider(28, range=0..200)
extent_y = Slider(20, range=0..200)
offset = Slider(0.1, range=0..1)
Z = Slider(0.5, range=0..3)
rectangular = Rectangular(Plane=PlaneXY(0, 0, 0), SizeX=X, SizeY=Y, ExtentX=extent_x, ExtentY=extent_y)  # -> flatten(Cells), Points
unit_z = UnitZ(Factor=Z)
negative = Negative(Value=offset)
offset_curve = OffsetCurve(Curve=rectangular.Cells, Distance=negative, Plane=PlaneXY(0, 0, 0), Corners=1)  # -> flatten(Curve)
extrude = Extrude(Base=offset_curve, Direction=unit_z)
cap_holes = CapHoles(Brep=extrude)
brep = Brep(cap_holes)

# ----
# running bond
brep_2 = Brep(brep)
X_2 = Number(X)
division = Division(A=X_2, B="2")
dispatch = Dispatch(List=brep_2, DispatchPattern=[True, False])  # -> ListA, ListB
unit_x = UnitX(Factor=division)
move = Move(Geometry=dispatch.ListA, Motion=unit_x)  # -> Geometry, Transform
merge = Merge(Data1=move.Geometry, Data2=dispatch.ListB)
brep_3 = Brep(merge)

# ----
# random colors
brep_4 = Brep(brep_3)
seed = Slider(0, range=0..100)
list_length = ListLength(List=brep_4)
random = Random(Range=Domain(0, 1), Number=list_length, Seed=seed, Integers=False)
gradient = Gradient(LowerLimit=0, UpperLimit=1, Parameter=random, stops=[0: RGB(224, 224, 224), 1: RGB(64, 64, 64)])
custom_preview = CustomPreview(Geometry=brep_4, Material=gradient)

# ----
# attractor
brep_5 = Brep(brep_3)
curve = Curve(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)
distance = Slider(14, range=0..25)
seed_2 = Slider(0, range=0..100)
factor = Slider(3, range=0..10)
area = Area(Geometry=brep_5)  # -> Area, Centroid
divide_distance = DivideDistance(Curve=curve, Distance=distance)  # -> Points, Tangents, Parameters
closest_point = ClosestPoint(Point=area.Centroid, Cloud=divide_distance.Points)  # -> ClosestPoint, CPIndex, Distance
bounds = Bounds(Numbers=closest_point.Distance)
list_length_2 = ListLength(List=closest_point.Distance)
random_2 = Random(Range=Domain(0, 1), Number=list_length_2, Seed=seed_2, Integers=False)
remap_numbers = RemapNumbers(Value=closest_point.Distance, Source=bounds, Target=Domain(0, 1))  # -> Mapped, Clipped
multiplication = Multiplication(A=remap_numbers.Mapped, B=random_2, C=factor)
gradient_2 = Gradient(LowerLimit=0, UpperLimit=1, Parameter=multiplication, stops=[0: RGB(224, 224, 224), 1: RGB(64, 64, 64)])
custom_preview_2 = CustomPreview(Geometry=brep_5, Material=gradient_2)
