# Grasshopper definition living-wall-1.gh (Grasshopper 1.0.7)
# Copyright: GNU General Public License 3.0
# plug-ins: BitmapPlus

# ----
# living wall
# noise attractor
# cellular noise
# using bitmap+
seed = Slider(44, range=0..100)
width = Slider(26, range=0..100)
height = Slider(7, range=0..100)
depth = Slider(39, range=0..500)
list = ValueList({"Euclidean": 0, "Manhattan": 1, "Natural": 2}, selected="Euclidean")
list_2 = ValueList({"Value": 0, "Distance2": 2, "Dist2Add": 3, "Dist2Sub": 4, "Dist2Mul": 5, "Dist2Div": 6}, selected="Dist2Div")
procedural_cellular = ProceduralCellular(
    Seed=seed,
    Width=width,
    Height=height,
    Depth=depth,
    BoundaryMode=list,
    InterpolationMode=list_2,
    Jitter=Slider(0.5, range=0..1),
    Frequency=Slider(0.275, range=0..1))
prev_image = PrevImage(SmartBitmap=procedural_cellular)
# scale hex modules: 4 sizes
# x-axis attractor
# round ends for modules
image = Data(procedural_cellular)

image_2 = Data(image)
# extract noise from image
bitmap_properties = BitmapProperties(Image=image_2)  # -> Boundary, Width, Height, HorizontalResolution, VerticalResolution, Format
deconstruct_bitmap = DeconstructBitmap(Image=image_2)
mesh_plane = MeshPlane(
    Boundary=bitmap_properties.Boundary,
    WidthCount=expr("x-1", bitmap_properties.Width),
    HeightCount=expr("x-1", bitmap_properties.Height))  # -> Mesh, Area
split_ahsv = SplitAHSV(Colour=deconstruct_bitmap)  # -> Alpha, Hue, Saturation, Value
deconstruct_mesh = DeconstructMesh(Mesh=mesh_plane.Mesh)  # -> Vertices, Faces, Colours, Normals
mesh_face = MeshFace(deconstruct_mesh.Faces)
point = Point(deconstruct_mesh.Vertices)
noise = Number(split_ahsv.Value)

size = Slider(1, range=0..100)
extent_x = Slider(36, range=0..100)
extent_x_2 = Slider(9, range=0..100)
attractors = Point([Point(3, 0, 4), Point(11, 0, 12), Point(15, 0, 9), Point(29, 0, 3), Point(23, 0, 12), Point(39, 0, 12), Point(34, 0, 8), Point(45, 0, 2), Point(48, 0, 9)])
min = Slider(0.5, range=0..2)
max = Slider(3, range=0..10)
scale = Slider(0.7, range=0..1)
z_shift = Slider(0.5, range=0..1)
angle = Slider(-20, range=-100..0)
depth_2 = Slider(1, range=0..10)
xz_plane = XZPlane(Origin=Point(0, 0, 0))
unit_y = UnitY(Factor=depth_2)
hexagonal = Hexagonal(Plane=xz_plane, Size=size, ExtentX=extent_x, ExtentY=extent_x_2)  # -> flatten(Cells), flatten(Points)
cells = Curve(hexagonal.Cells)
construct_domain = ConstructDomain(DomainStart=min, DomainEnd=max)
extrude = Extrude(Base=cells, Direction=unit_y)
move = Move(Geometry=cells, Motion=unit_y)  # -> Geometry, Transform
boundary_surfaces = BoundarySurfaces(Edges=move.Geometry)
relay = Relay([extrude, boundary_surfaces])

# ----
# attractor
point_2 = Point(point)
yz_plane = YZPlane(Origin=Point(0, 0, 0))
scale_2 = Slider(2, range=0..10)
noise_2 = Number(noise)
attraction = Slider(8, range=0..25)
bounds = Bounds(Numbers=noise_2)
rotate = Rotate(Geometry=point_2, Angle=1.570796327, Plane=yz_plane)  # -> Geometry, Transform
remap_numbers = RemapNumbers(Value=noise_2, Source=bounds, Target=attraction)  # -> Mapped, Clipped
scale_3 = Scale(Geometry=rotate.Geometry, Center=Point(0, 0, 0), Factor=scale_2)  # -> Geometry, Transform
unit_y_2 = UnitY(Factor=remap_numbers.Mapped)
move_2 = Move(Geometry=scale_3.Geometry, Motion=unit_y_2)  # -> Geometry, Transform
attractors_2 = Point(move_2.Geometry)

attractors_3 = Point(attractors_2)
closest_point = ClosestPoint(Point=hexagonal.Points, Cloud=attractors_3)  # -> ClosestPoint, CPIndex, Distance
bounds_2 = Bounds(Numbers=closest_point.Distance)
remap_numbers_2 = RemapNumbers(Value=closest_point.Distance, Source=bounds_2, Target=construct_domain)  # -> Mapped, Clipped
negative = Negative(Value=remap_numbers_2.Mapped)
unit_y_3 = UnitY(Factor=negative)
move_3 = Move(Geometry=hexagonal.Cells, Motion=unit_y_3)  # -> Geometry, Transform
area = Area(Geometry=move_3.Geometry)  # -> Area, Centroid
centroid = Point(area.Centroid)
yz_plane_2 = YZPlane(Origin=centroid)
scale_4 = Scale(Geometry=move_3.Geometry, Center=area.Centroid, Factor=scale)  # -> Geometry, Transform
unit_z = UnitZ(Factor=z_shift)
move_4 = Move(Geometry=scale_4.Geometry, Motion=unit_z)  # -> Geometry, Transform
rotate_2 = Rotate(Geometry=move_4.Geometry, Angle=degrees(angle), Plane=yz_plane_2)  # -> Geometry, Transform
area_2 = Area(Geometry=rotate_2.Geometry)  # -> Area, Centroid
xz_plane_2 = XZPlane(Origin=area_2.Centroid)
yz_plane_3 = YZPlane(Origin=area_2.Centroid)
rotate_3 = Rotate(Geometry=xz_plane_2, Angle=degrees(angle), Plane=yz_plane_3)  # -> Geometry, Transform
min_2 = Integer(min)
max_2 = Integer(max)
circle = Circle(Plane=rotate_3.Geometry, Radius="0.5")
gradient = Gradient(
    LowerLimit=min_2,
    UpperLimit=max_2,
    Parameter=remap_numbers_2.Mapped,
    stops=[0: RGB(68, 1, 84), 0.167: RGB(68, 57, 131), 0.334: RGB(49, 104, 142), 0.501: RGB(33, 145, 140), 0.668: RGB(53, 183, 121), 0.835: RGB(144, 215, 67), 1: RGB(253, 231, 37)])
colour = Colour(gradient)
custom_preview = CustomPreview(Geometry=relay, Material=colour)
ruled_surface = RuledSurface(CurveA=hexagonal.Cells, CurveB=circle)
custom_preview_2 = CustomPreview(Geometry=ruled_surface, Material=gradient)
