# Grasshopper definition random-grove.gh (Grasshopper 1.0.7)
# Copyright: GNU General Public License 3.0

# ---- group: parametrically model a tree
# random grove
# parametric tree
trunk_height = Slider(5, range=0..100)
trunk_radius = Slider(0.5, range=0..1)
tree_height = Slider(20, range=0..100)
divisions = Slider(3, range=0..10)
# region
canopy_radius = Slider(5, range=0..10)
conical_tree = ConicalTree(trunk_height=trunk_height, relay=trunk_radius, A=tree_height, relay_2=divisions, relay_3=canopy_radius)  # -> pipe_2, result
trunk = Brep(conical_tree.pipe_2)
canopy = Brep(conical_tree.result)

# ---- group: populate a circular region
radius = Slider(50, range=0..100)
count = Slider(100, range=0..1000)
# cull by distance
seed = Slider(0, range=0..100)
circle = Circle(Plane=PlaneXY(0, 0, 0), Radius=radius)
boundary_surfaces = BoundarySurfaces(Edges=circle)
populate_geometry = PopulateGeometry(Geometry=boundary_surfaces, Count=count, Seed=seed)
surface = Surface(boundary_surfaces)
point = Point(populate_geometry)
count_2 = Number(count)

# ----
point_2 = Point(point)
count_3 = Number(count_2)
closest_points = ClosestPoints(Point="0,0,0", Cloud=point_2, Count=count_3)  # -> ClosestPoint, CPIndex, Distance
random = Random(Range=Domain(0, 1), Number=count_3, Seed=seed)
bounds = Bounds(Numbers=closest_points.Distance)
remap_numbers = RemapNumbers(Value=closest_points.Distance, Source=bounds, Target=Domain(0, 1))  # -> Mapped, Clipped
graph_mapper = GraphMapper(
    remap_numbers.Mapped,
    x0=0,
    x1=1,
    y0=0,
    y1=1,
    container_name="Bezier",
    cpx=[0, 0.9543220997, 0.9275838733, 1],
    cpy=[0, 0.1256693006, 0.4286991358, 1])
smaller_than = SmallerThan(FirstNumber=graph_mapper, SecondNumber=random)  # -> SmallerThan, OrEqualTo
cull_pattern = CullPattern(List=closest_points.ClosestPoint, CullPattern=smaller_than.SmallerThan)
point_3 = Point(cull_pattern)

# ---- group: move and scale trees
# transform
trunks = Geometry(trunk)
canopy_2 = Geometry(canopy)
point_4 = Point(point_3)
list_length = ListLength(List=point_4)
merge = Merge(Data1=trunks, Data2=canopy_2)
range = Range(Domain="0.5 To 1.0", Steps=expr("x-1", list_length))  # -> reverse(Range)
vector_2pt = Vector2Pt(PointA="0,0,0", PointB=point_4, Unitize=False)  # -> Vector, Length
graph_mapper_2 = GraphMapper(
    range,
    x0=0,
    x1=1,
    y0=0,
    y1=1,
    container_name="Bezier",
    cpx=[0, 0.5339580774, 0.7271949649, 1],
    cpy=[0, 0.3154498339, 0.5481587648, 0.9981682897])
move = Move(Geometry=merge, Motion=vector_2pt.Vector)  # -> Geometry, Transform
scale = Scale(Geometry=move.Geometry, Center=vector_2pt.Vector, Factor=graph_mapper_2)  # -> Geometry, Transform
culled_count = Integer(list_length)
trees = Brep(scale.Geometry)

# ---- group: color trees
# tree color
trees_2 = Brep(trees)
# ground color
culled_count_2 = Integer(culled_count)
canopy_color = ColourSwatch(SwatchColor=RGBA(58, 94, 58, 232))
canopy_color_2 = ColourSwatch(SwatchColor=RGBA(64, 128, 117, 232))
canopy_color_3 = ColourSwatch(SwatchColor=RGBA(123, 128, 64, 232))
colour = Colour([canopy_color, canopy_color_2, canopy_color_3])
range_2 = Range(Domain=Domain(0, 1), Steps=culled_count_2)
interpolate_data = InterpolateData(Data=colour, Parameter=range_2, Interpolation=2)
explode_tree = ExplodeTree(Data=trees_2)  # -> _0000, _0001
trunks_2 = Brep(explode_tree._0000)
trunk_color = ColourSwatch(SwatchColor=RGB(139, 76, 57))
canopy_3 = Brep(explode_tree._0001)
custom_preview = CustomPreview(Geometry=trunks_2, Material=trunk_color)
custom_preview_2 = CustomPreview(Geometry=canopy_3, Material=interpolate_data)

# ---- group: model and color ground
surface_2 = Surface(surface)
scale_2 = Slider(1.05, range=0..10)
depth = Slider(2, range=0..10)
scale_3 = Scale(Geometry=surface_2, Center=Point(0, 0, 0), Factor=scale_2)  # -> Geometry, Transform
negative = Negative(Value=depth)
unit_z = UnitZ(Factor=negative)
extrude = Extrude(Base=scale_3.Geometry, Direction=unit_z)
ground_color = ColourSwatch(SwatchColor=RGB(140, 123, 118))
custom_preview_3 = CustomPreview(Geometry=extrude, Material=ground_color)

# ==== cluster ConicalTree
trunk_height = ClusterInput()
relay = ClusterInput()
A = ClusterInput()
relay_2 = ClusterInput()
relay_3 = ClusterInput()
unit_z = UnitZ(Factor=trunk_height)
subtraction = Subtraction(A=A, B=trunk_height)
move = Move(Geometry="0,0,0", Motion=unit_z)  # -> Geometry, Transform
top_of_trunk = Point(move.Geometry)
unit_z_2 = UnitZ(Factor=subtraction)
division = Division(A=subtraction, B=relay_2)
move_2 = Move(Geometry=top_of_trunk, Motion=unit_z_2)  # -> Geometry, Transform
line = Line(StartPoint="0,0,0", EndPoint=move.Geometry)
line_2 = Line(StartPoint=top_of_trunk, EndPoint=move_2.Geometry)
pipe = Pipe(Curve=line, Radius=relay, Caps="1")
divide_curve = DivideCurve(Curve=line_2, Count=relay_2, Kinks=False)  # -> Points, Tangents, Parameters
pipe_2 = ClusterOutput(pipe)
split_list = SplitList(List=divide_curve.Points, Index=relay_2)  # -> ListA, ListB
range = Range(Domain="1 To 0.5", Steps=expr("x-1", relay_2))
cone = Cone(Base=split_list.ListA, Radius=relay_3, Length=division)  # -> Cone, Tip
multiplication = Multiplication(A=range, B="2")
scale_nu = ScaleNU(Geometry=cone.Cone, Plane=split_list.ListA, ScaleX=range, ScaleY=range, ScaleZ=multiplication)  # -> Geometry, Transform
cap_holes = CapHoles(Brep=scale_nu.Geometry)
solid_union = SolidUnion(Breps=cap_holes)
result = ClusterOutput(solid_union)
