# Grasshopper definition space-filling-curve.gh (Grasshopper 1.0.7)
# plug-ins: Kangaroo2 Components, EleFront

scale = Slider(0.6, range=0..1)

# ----
# space filling curve
radius = Slider(36, range=0..100)
count = Slider(4, range=0..10)
seed = Slider(1, range=0..100)
circle = Circle(Plane=PlaneXY(0, 0, 0), Radius=radius)
scale_2 = Scale(Geometry=circle, Center=Point(0, 0, 0), Factor=scale)  # -> Geometry, Transform
boundary_surfaces = BoundarySurfaces(Edges=scale_2.Geometry)
populate_geometry = PopulateGeometry(Geometry=boundary_surfaces, Count=count, Seed=seed)
random = Random(Range="3 To 15", Number=count, Seed=seed)
circle_2 = Circle(Plane=populate_geometry, Radius=random)
region_difference = RegionDifference(CurvesA=circle, CurvesB=circle_2)
boundary_surfaces_2 = BoundarySurfaces(Edges=region_difference)
mesh_surface = MeshSurface(Surface=boundary_surfaces_2, UCount="250", VCount="250", Overhang=True, Equalize=False)
surface = Surface(boundary_surfaces_2)
mesh = Mesh(mesh_surface)

circle_3 = Circle(circle)
offset = Slider(3, range=0..10)
point_spacing = Slider(1, range=0..1)
amplitude = Slider(0.15, range=0..1)
seed_2 = Slider(2, range=0..10)
negative = Negative(Value=offset)
offset_curve = OffsetCurve(Curve=circle_3, Distance=negative, Plane=PlaneXY(0, 0, 0), Corners=1)
divide_length = DivideLength(Curve=offset_curve, Length=point_spacing)  # -> simplify(Points), Tangents, Parameters
amplitude_2 = Amplitude(Vector=divide_length.Points, Amplitude=amplitude)
list_length = ListLength(List=amplitude_2)
random_2 = Random(Range="0 To 2*PI", Number=list_length, Seed=seed_2)
rotate = Rotate(Geometry=amplitude_2, Angle=random_2, Plane=PlaneXY(0, 0, 0))  # -> simplify(Geometry), Transform
move = Move(Geometry=divide_length.Points, Motion=rotate.Geometry)  # -> Geometry, Transform
point = Point(move.Geometry)

# ---- group: run & reset
run = BooleanToggle(True)
reset = BooleanToggle(True)

# ----
boolean = Boolean(True)

mesh_2 = Mesh(mesh)
point_2 = Point(point)
point_3 = Point(point)
point_4 = Point(point)
list_length_2 = ListLength(List=point_4)
polyline = PolyLine(Vertices=point_2, Closed="True")  # -> flatten(Polyline)
series = Series(Start=0, Step=1, Count=list_length_2)
partition_list = PartitionList(List=series, Size=list_length_2)
explode = Explode(Curve=polyline, Recursive=True)  # -> Segments, Vertices
line = Line(explode.Segments)
list_length_3 = ListLength(List=line)
series_2 = Series(Start=0, Step=1, Count=list_length_3)
partition_list_2 = PartitionList(List=series_2, Size=list_length_3)
shift_list = ShiftList(List=partition_list_2, Shift=1, Wrap=True)
shift_list_2 = ShiftList(List=partition_list, Shift=1, Wrap=True)
shift_list_3 = ShiftList(List=explode.Segments, Shift=1, Wrap=True)
integer = Integer(partition_list)
integer_2 = Integer(shift_list_2)
integer_3 = Integer(partition_list_2)
integer_4 = Integer(shift_list)
length_line = LengthLine(Line=flatten(explode.Segments), Length="6", Strength="10")
show = Show(G=polyline)
angle = Angle(LineA=explode.Segments, LineB=shift_list_3, RestAngle="0", Strength="1000")
collider = Collider(Objects=point_4, Radii="2", IgnoreA=integer, IgnoreB=integer_2, Strength="100")
onmesh = OnMesh(Points=point_3, Mesh=mesh_2, Strength="1000")
collider_2 = Collider(Objects=line, Radii="0.5", IgnoreA=integer_3, IgnoreB=integer_4, Strength="100")
entwine = Entwine(
    Branch00=show,
    Branch01=onmesh,
    Branch02=length_line,
    Branch03=angle,
    Branch04=collider,
    Branch05=collider_2,
    FlattenInputs=True)
reset_2 = Boolean(reset)
run_2 = Boolean(run)
solver = Solver(GoalObjects=entwine, Reset=reset_2, Threshold=0, Tolerance=0.01, On=run_2)  # -> I, V, O

interpolate = Interpolate(Vertices=solver.V, Degree=3, Periodic=boolean, KnotStyle=1)  # -> Curve, Length, Domain

curve = Curve(interpolate.Curve)

# ---- group: step solver
data = Data(entwine)
momentum = BooleanToggle(True)
damping = Slider(0, range=0..1)
subiterations = Slider(10, range=0..100)
animate = BooleanToggle(True)
stepsolver = StepSolver(GoalObjects=data, Tolerance="0.0001", Momentum=momentum, Damping=damping, SubIterations=subiterations, Animate=animate)  # -> I, V, O
boolean_2 = Boolean(True)
interpolate_2 = Interpolate(Vertices=stepsolver.V, Degree=3, Periodic=boolean_2, KnotStyle=1)  # -> Curve, Length, Domain
curve_2 = Curve(interpolate_2.Curve)

# ---- group: baking
curve_3 = Curve(curve_2)
layer = Slider(30, range=1..36)
define_layer = DefineLayer(Name=layer)
define_object_attributes = DefineObjectAttributes(Layer=define_layer)
bake_objects = BakeObjects(Geometry=curve_3, Attributes=define_object_attributes, Bake=False)
