# Grasshopper definition space-filling-vessel.gh (Grasshopper 1.0.7)
# Copyright: GNU General Public License 3.0

# ----
# space filling vessel
curve = Curve([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])
z_step = Slider(3, range=0..10)
list_length = ListLength(List=curve)
range = Range(Domain=Domain(0, 1), Steps=expr("x-1", list_length))
series = Series(Start=0, Step=z_step, Count=list_length)
graph_mapper = GraphMapper(
    range,
    x0=0,
    x1=1,
    y0=0,
    y1=1,
    container_name="Bezier",
    cpx=[0, 0.7498430014, 0.4092261195, 1],
    cpy=[0, 0.2970408797, 0.562820673, 1])
unit_z = UnitZ(Factor=series)
move = Move(Geometry=curve, Motion=unit_z)  # -> Geometry, Transform
remap_numbers = RemapNumbers(Value=graph_mapper, Source=Domain(0, 1), Target="1 To 2")  # -> Mapped, Clipped
scale_nu = ScaleNU(Geometry=move.Geometry, Plane=PlaneXY(0, 0, 0), ScaleX=remap_numbers.Mapped, ScaleY=remap_numbers.Mapped, ScaleZ=1)  # -> Geometry, Transform
loft_options = LoftOptions(Closed=False, Adjust=False, Rebuild=0, Refit=0, Type="1")
loft = Loft(Curves=scale_nu.Geometry, Options=loft_options)
custom_preview = CustomPreview(Geometry=loft, Material=ColourSwatch(SwatchColor=RGB(227, 227, 227)))
