# Grasshopper definition strange-attractor.gh (Grasshopper 1.0.7)
# plug-ins: Chen System, EleFront

# ---- group: chen system strange attractor
# strange attractor
# using chimpanzee
number_slider = Slider(44, range=0..100)
chen_system = ChenSystem(A=number_slider, Iterations=Slider(40000, range=0..100000))
interpolate = Interpolate(Vertices=chen_system, Degree=3, Periodic=False, KnotStyle=1)  # -> Curve, Length, Domain

# ---- group: variable pipe
# using elefront
slider = Slider(0.4, range=0..8)
relay = Relay([Slider(1.6, range=0..8), slider, Slider(0.1, range=0..8)])
list_length = ListLength(List=relay)
divide = DivideCurve(Curve=interpolate.Curve, Count=expr("x-1", list_length), Kinks=False)  # -> Points, Tangents, Parameters
vpipe = PipeVariable(Curve=interpolate.Curve, Parameters=divide.Parameters, Radii=relay, Caps=2)
bake_objects = BakeObjects(Geometry=vpipe, Bake=False)
custom_preview = CustomPreview(Geometry=vpipe, Material=ColourSwatch(SwatchColor=RGB(255, 255, 255)))
