# Grasshopper definition surface-export.gh (Grasshopper 1.0.7)
# Copyright: GNU General Public License
# plug-ins: Docofossor

# ----
# terrain export
# using docofossor
size = Slider(1, range=0..100)
X = Slider(300, range=0..1000)
Y = Slider(300, range=0..1000)
surface = Surface(<surface referenced from the Rhino model>)
square = Square(Plane=PlaneXY(0, 0, 0), Size=size, ExtentX=X, ExtentY=Y)  # -> Cells, flatten(Points)
import_points = ImportPoints(Pts=square.Points)
cut_fill_in_surface = CutFillInSurface(Df=import_points, Srf=surface)  # -> Df, Vol
grid_mesh = GridMesh(Df=cut_fill_in_surface.Df)
export_xyz = ExportXYZ(Df=cut_fill_in_surface.Df, F="parametric_landform", W=Toggle(True))
