# Grasshopper definition terrain-export.gh (Grasshopper 1.0.7)
# plug-ins: Docofossor

# ---- group: import xyz data as grid
# using docofossor
resolution = Panel("1")
# import terrain
file_path = FilePath("D:\generative-design\grasshopper\data\elevation.xyz")
import_xyz = ImportXYZ(F=file_path, N=resolution)
grid_shift = GridShift(Df=import_xyz)
grid_mesh = GridMesh(Df=grid_shift)
custom_preview = CustomPreview(Geometry=grid_mesh, Material=ColourSwatch(SwatchColor=RGB(204, 204, 204)))

# ---- group: grade path along curve
# grade terrain
point = Point([Point(40.12628892, 56.34606202, 10.83309371), Point(42.27544677, 52.1317047, 11.12692908), Point(39.3251499, 48.8502798, 11.68504499), Point(32.36525037, 52.0480171, 12.36396472), Point(34.0394827, 60.09095025, 12.46644012), Point(44.7076506, 61.50995536, 11.27369495), Point(51.44090332, 56.51487493, 10.72774025)])
interpolate = Interpolate(Vertices=point, Degree=3, Periodic=False, KnotStyle=1)  # -> Curve, Length, Domain
dfcutfillinpath = CutFillInPath(Df=grid_shift, Crv=interpolate.Curve, W=Slider(1, range=0..10), Sa=Slider(25, range=0..90))  # -> Df, Vol
dfgridmesh = GridMesh(Df=dfcutfillinpath.Df)
custom_preview_2 = CustomPreview(Geometry=dfgridmesh, Material=ColourSwatch(SwatchColor=RGB(204, 204, 204)))

# ---- group: generate landform from noise
radius = Panel("15")
wavelength = Slider(10, range=0..16)
amplitude = Slider(1, range=0..16)
smoothing = Slider(0, range=0..16)
point_2 = Point(Point(40.79787807, 46.65670225, 10.93171013))
circle = Circle(Plane=point_2, Radius=radius)
noise = Noise(Df=grid_shift, Crv=circle, Wl=wavelength, A=amplitude, S=smoothing)
grid_mesh_2 = GridMesh(Df=noise)
custom_preview_3 = CustomPreview(Geometry=grid_mesh_2, Material=ColourSwatch(SwatchColor=RGB(204, 204, 204)))

# ----
# export terrain
panel = Panel("landform")
export_xyz = ExportXYZ(Df=dfcutfillinpath.Df, F=panel, W=Toggle(False))

export_xyz_2 = ExportXYZ(Df=noise, F="noise", W=Toggle(False))
