# Grasshopper definition terrain-grading.gh (Grasshopper 1.0.7)
# plug-ins: Docofossor

# ---- group: import xyz data as grid
# using docofossor
resolution = Panel("2")
# import terrain
file_path = FilePath("D:\rhino\grasshopper\elevation.xyz")
import_xyz = ImportXYZ(F=file_path, N=resolution)
grid_shift = GridShift(Df=import_xyz)
grid_mesh = GridMesh(Df=grid_shift)
custom_preview = CustomPreview(Geometry=grid_mesh, Material=ColourSwatch(SwatchColor=RGB(204, 204, 204)))

# ---- group: grade path along curve
# grade terrain
point = Point([Point(18, 62, 0), Point(24, 46, 0), Point(30, 34, 0), Point(35, 29, 0), Point(41, 27, 0), Point(49, 29, 0), Point(55, 36, 0), Point(58, 44, 0), Point(58, 53, 0), Point(57, 58, 0)])
unit_z = UnitZ(Factor="10")
move = Move(Geometry=point, Motion=unit_z)  # -> Geometry, Transform
interpolate = Interpolate(Vertices=move.Geometry, Degree=3, Periodic=False, KnotStyle=1)  # -> Curve, Length, Domain
dfcutfillinpath = CutFillInPath(Df=grid_shift, Crv=interpolate.Curve, W=Slider(1, range=0..10), Sa=Slider(30, range=0..90))  # -> Df, Vol
dfgridmesh = GridMesh(Df=dfcutfillinpath.Df)
custom_preview_2 = CustomPreview(Geometry=dfgridmesh, Material=ColourSwatch(SwatchColor=RGB(204, 204, 204)))

# ---- group: generate landform from noise
radius = Panel("15")
wavelength = Slider(10, range=0..16)
amplitude = Slider(1, range=0..16)
smoothing = Slider(0, range=0..16)
point_2 = Point(Point(42.92579671, 47.1277512, 10.93171013))
circle = Circle(Plane=point_2, Radius=radius)
noise = Noise(Df=dfcutfillinpath.Df, Crv=circle, Wl=wavelength, A=amplitude, S=smoothing)
grid_mesh_2 = GridMesh(Df=noise)
custom_preview_3 = CustomPreview(Geometry=grid_mesh_2, Material=ColourSwatch(SwatchColor=RGB(204, 204, 204)))

# ---- group: calculate cut and fill
grid_compare = GridCompare(Df1=grid_shift, Df2=noise)  # -> Cut, Fill, Balance, Df
cut = Panel(grid_compare.Cut)
fill = Panel(grid_compare.Fill)
grid_mesh_3 = GridMesh(Df=grid_compare.Df)
custom_preview_4 = CustomPreview(Geometry=grid_mesh_3, Material=ColourSwatch(SwatchColor=RGB(204, 204, 204)))
