# Grasshopper definition terrain-modeling.gh (Grasshopper 1.0.7)
# plug-ins: Docofossor

# ---- group: import xyz data as grid
# import terrain
# using docofossor
file_path = FilePath("D:\generative-design\grasshopper\data\governors-island-landform.xyz")
source_resolution = Slider(1, range=0..1)
import_xyz = ImportXYZ(F=file_path)
grid_shift = GridShift(Df=import_xyz)
list_item = ListItem(List=grid_shift, Index="1", Wrap=True)
multiplication = Multiplication(A=list_item, B=source_resolution)
division = Division(A=multiplication, B="2")
construct_point = ConstructPoint(XCoordinate=0, YCoordinate=division, ZCoordinate=0)
xz_plane = XZPlane(Origin=construct_point)
grid_mesh = GridMesh(Df=grid_shift)
mirror = Mirror(Geometry=grid_mesh, Plane=xz_plane)  # -> Geometry, Transform
custom_preview = CustomPreview(Geometry=mirror.Geometry, Material=ColourSwatch(SwatchColor=RGB(230, 230, 230)))
