# Grasshopper definition topographic-simulation.gh (Grasshopper 1.0.7)
# Copyright: GNU General Public License 3.0
# plug-ins: Docofossor

# ---- group: import terrain
# terrain modeling
# import
# using docofossor
file_path = FilePath("D:\generative-design\grasshopper\data\governors-island-landform.xyz")
resolution = Slider(5, range=0..10)
import_xyz = ImportXYZ(F=file_path, N=resolution)
grid_shift = GridShift(Df=import_xyz)
data = Data(grid_shift)

# ---- group: mirror terrain
# transform
panel = Panel("10")
data_2 = Data(data)
split_list = SplitList(List=data_2, Index=panel)  # -> ListA, ListB
grid_points = GridPoints(Df=data_2)
grid_mesh = GridMesh(Df=data_2)
area = Area(Geometry=grid_mesh)  # -> Area, Centroid
xz_plane = XZPlane(Origin=area.Centroid)
mirror = Mirror(Geometry=grid_points, Plane=xz_plane)  # -> Geometry, Transform
import_points = ImportPoints(Pts=mirror.Geometry)
split_list_2 = SplitList(List=import_points, Index="10")  # -> ListA, ListB
merge = Merge(Data1=split_list.ListA, Data2=split_list_2.ListB)
data_3 = Data(merge)

# ---- group: import and transform new landform
# surface
surface = Surface(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)
scale = Slider(30, range=0..100)
X = Slider(1414, range=0..1500)
Y = Slider(270, range=0..1000)
Z = Slider(10, range=0..100)
# grading
angle = Slider(0, range=0..360)
scale_2 = Scale(Geometry=surface, Center=Point(0, 0, 0), Factor=scale)  # -> Geometry, Transform
vector_xyz = VectorXYZ(XComponent=X, YComponent=Y, ZComponent=Z)  # -> Vector, Length
move = Move(Geometry=scale_2.Geometry, Motion=vector_xyz.Vector)  # -> Geometry, Transform
box_properties = BoxProperties(Box=move.Geometry)  # -> Center, Diagonal, Area, Volume, Degeneracy
rotate = Rotate(Geometry=move.Geometry, Angle=degrees(angle), Plane=box_properties.Center)  # -> Geometry, Transform
surface_2 = Surface(rotate.Geometry)

# ---- group: grade new landform
data_4 = Data(data_3)
surface_3 = Surface(surface_2)
slope = Slider(33, range=0..90)
max_distance = Slider(30, range=0..250)
fill_in_surface = FillInSurface(Df=data_4, Srf=surface_3, Sa=slope, D=max_distance)  # -> Df, Vol
grid_mesh_2 = GridMesh(Df=fill_in_surface.Df)
custom_preview = CustomPreview(Geometry=grid_mesh_2, Material=ColourSwatch(SwatchColor=RGB(204, 204, 204)))
data_5 = Data(fill_in_surface.Df)
mesh = Mesh(grid_mesh_2)

# ----
# export
data_6 = Data(data_5)
export_xyz = ExportXYZ(Df=data_6, F="hills", W=Toggle(False))
