# Grasshopper definition trigonometric-landforms.gh (Grasshopper 1.0.7)
# Copyright: GNU General Public License 3.0

# ----
# trigonometric landforms
# curves
u = Slider(4, range=0..10)
w = Slider(0.66, range=0..1)
count = Slider(7, range=0..10)
# surface
A = Slider(0.7, range=0..2)
pi = Pi(Factor=u)
series = Series(Start=0, Step=w, Count=count)  # -> graft(Series)
range = Range(Domain=pi, Steps="10")
expression = Expression(u=range, w=series, A=A, Expression="sin(w*u)*A")
construct_point = ConstructPoint(XCoordinate=range, YCoordinate=0, ZCoordinate=expression)
interpolate = Interpolate(Vertices=construct_point, Degree=3, Periodic=False, KnotStyle=1)  # -> Curve, Length, Domain
curve = Curve(interpolate.Curve)

curve_2 = Curve(curve)
y_step = Slider(2, range=0..10)
# cutting plane
count_2 = Integer(count)
series_2 = Series(Start=0, Step=y_step, Count=count_2)  # -> graft(Series)
unit_y = UnitY(Factor=series_2)
move = Move(Geometry=curve_2, Motion=unit_y)  # -> flatten(Geometry), Transform
loft = Loft(Curves=move.Geometry, Options={Adjust=False, Closed=False, LoftEnds=0, LoftSimp=0, LoftType=0, Rebuild=10, Refit=0.01})
custom_preview = CustomPreview(Geometry=loft, Material=ColourSwatch(SwatchColor=RGB(217, 217, 217)))

surface = Surface(loft)
Z = Slider(-0.3, range=-1..1)
bounding_box = BoundingBox(Content=surface, Plane=PlaneXY(0, 0, 0))  # -> Box, Box_2
deconstruct_box = DeconstructBox(Box=bounding_box.Box)  # -> Plane, X, Y, Z
unit_z = UnitZ(Factor=Z)
plane_surface = PlaneSurface(Plane=PlaneXY(0, 0, 0), XSize=deconstruct_box.X, YSize=deconstruct_box.Y)
move_2 = Move(Geometry=plane_surface, Motion=unit_z)  # -> Geometry, Transform
custom_preview_2 = CustomPreview(Geometry=move_2.Geometry, Material=ColourSwatch(SwatchColor=RGB(0, 0, 0)))
