# Grasshopper definition trigonometry-basics.gh (Grasshopper 1.0.7)
# Copyright: GNU General Public License 3.0

# trigonometry basics
# curves
u = Slider(2, range=0..10)
u_2 = Slider(2, range=0..10)
# translation
u_3 = Slider(2, range=0..10)
a = Slider(1.5, range=0..10)
b = Slider(1, range=0..10)
# scaling
u_4 = Slider(2, range=0..10)
r = Slider(0.5, range=-2..2)
# cutting
u_5 = Slider(1, range=0..10)
# modulation
u_6 = Slider(2, range=0..10)
w = Slider(0.5, range=0..10)
# amplitude
u_7 = Slider(2, range=0..10)
A = Slider(2, range=0..10)
# dampening
u_8 = Slider(2, range=0..10)
h = Slider(2, range=0..10)
# expression
u_9 = Slider(2, range=0..10)
# decay function
u_10 = Slider(4, range=0..10)
w_2 = Slider(0.5, range=0..10)
A_2 = Slider(2, range=0..10)
halflife = Slider(4, range=0..10)
# series
u_11 = Slider(4, range=0..10)
w_3 = Slider(0.5, range=0..10)
A_3 = Slider(1.2, range=0..10)
step = Slider(1, range=0..10)
count = Slider(10, range=0..100)
# texturing
u_12 = Slider(2, range=0..10)
# textured series
u_13 = Slider(2, range=0..10)
count_2 = Slider(6, range=0..10)
pi = Pi(Factor=u_12)
pi_2 = Pi(Factor=u_8)
pi_3 = Pi(Factor=u_9)
pi_4 = Pi(Factor=u_10)
pi_5 = Pi(Factor=u_11)
pi_6 = Pi(Factor=u_7)
pi_7 = Pi(Factor=u_3)
pi_8 = Pi(Factor=u_4)
pi_9 = Pi(Factor=u_5)
pi_10 = Pi(Factor=u_6)
pi_11 = Pi(Factor=u)
pi_12 = Pi(Factor=u_2)
series = Series(Start="1", Step=1, Count=count_2)  # -> graft(Series)
pi_13 = Pi(Factor=u_13)
series_2 = Series(Start="1", Step=step, Count=count)  # -> graft(Series)
range = Range(Domain=pi, Steps="100")
range_2 = Range(Domain=pi_2, Steps="100")
range_3 = Range(Domain=pi_3, Steps="100")
range_4 = Range(Domain=pi_4, Steps="100")
range_5 = Range(Domain=pi_5, Steps="100")
range_6 = Range(Domain=pi_6, Steps="100")
range_7 = Range(Domain=pi_7, Steps="100")
range_8 = Range(Domain=pi_8, Steps="100")
range_9 = Range(Domain=pi_9, Steps="100")
range_10 = Range(Domain=pi_10, Steps="100")
range_11 = Range(Domain=pi_11, Steps="100")
range_12 = Range(Domain=pi_12, Steps="100")
range_13 = Range(Domain=pi_13, Steps="100")
division = Division(A=range_10, B=w)
expression = Expression(u=range_3, Expression="sin(u)")
expression_2 = Expression(u=range_4, w=w_2, A=A_2, l=halflife, Expression="sin(u/w)*A*(0.5^(u/l))")
expression_3 = Expression(u=range, Expression="sin(2*u)/2+sin(u)")
sine = Sine(Value=range_9)
sine_2 = Sine(Value=range_6)
sine_3 = Sine(Value=range_11)
cosine = Cosine(Value=range_12)
expression_4 = Expression(u=range_5, w=w_3, A=A_3, l=series_2, Expression="sin(u/w)*A*(0.5^(u/l))")
sine_4 = Sine(Value=range_7)
sine_5 = Sine(Value=range_8)
expression_5 = Expression(u=range_13, A=series, Expression="sin(A*u)/A+sin(u)")
sine_6 = Sine(Value=range_2)
division_2 = Division(A=range_2, B=h)
sine_7 = Sine(Value=division)
multiplication = Multiplication(A=sine_2, B=A)
construct_point = ConstructPoint(XCoordinate=range_9, YCoordinate=sine, ZCoordinate=0)
construct_point_2 = ConstructPoint(XCoordinate=range_11, YCoordinate=sine_3, ZCoordinate=0)
construct_point_3 = ConstructPoint(XCoordinate=range_12, YCoordinate=cosine, ZCoordinate=0)
construct_point_4 = ConstructPoint(XCoordinate=range_3, YCoordinate=expression, ZCoordinate=0)
multiplication_2 = Multiplication(A=range_8, B=r)
multiplication_3 = Multiplication(A=sine_5, B=r)
addition = Addition(A=range_7, B=a)
addition_2 = Addition(A=sine_4, B=b)
power = Power(A="0.5", B=division_2)
construct_point_5 = ConstructPoint(XCoordinate=range_6, YCoordinate=multiplication, ZCoordinate=0)
construct_point_6 = ConstructPoint(XCoordinate=range_10, YCoordinate=sine_7, ZCoordinate=0)
construct_point_7 = ConstructPoint(XCoordinate=range, YCoordinate=expression_3, ZCoordinate=0)
construct_point_8 = ConstructPoint(XCoordinate=range_13, YCoordinate=expression_5, ZCoordinate=0)
interpolate = Interpolate(Vertices=construct_point, Degree=3, Periodic=False, KnotStyle=1)  # -> Curve, Length, Domain
interpolate_2 = Interpolate(Vertices=construct_point_2, Degree=3, Periodic=False, KnotStyle=1)  # -> Curve, Length, Domain
interpolate_3 = Interpolate(Vertices=construct_point_3, Degree=3, Periodic=False, KnotStyle=1)  # -> Curve, Length, Domain
construct_point_9 = ConstructPoint(XCoordinate=addition, YCoordinate=addition_2, ZCoordinate=0)
construct_point_10 = ConstructPoint(XCoordinate=multiplication_2, YCoordinate=multiplication_3, ZCoordinate=0)
construct_point_11 = ConstructPoint(XCoordinate=range_4, YCoordinate=expression_2, ZCoordinate=0)
construct_point_12 = ConstructPoint(XCoordinate=range_5, YCoordinate=expression_4, ZCoordinate=0)
interpolate_4 = Interpolate(Vertices=construct_point_4, Degree=3, Periodic=False, KnotStyle=1)  # -> Curve, Length, Domain
multiplication_4 = Multiplication(A=sine_6, B=power)
interpolate_5 = Interpolate(Vertices=construct_point_5, Degree=3, Periodic=False, KnotStyle=1)  # -> Curve, Length, Domain
interpolate_6 = Interpolate(Vertices=construct_point_6, Degree=3, Periodic=False, KnotStyle=1)  # -> Curve, Length, Domain
interpolate_7 = Interpolate(Vertices=construct_point_7, Degree=3, Periodic=False, KnotStyle=1)  # -> Curve, Length, Domain
construct_point_13 = ConstructPoint(XCoordinate=range_2, YCoordinate=multiplication_4, ZCoordinate=0)
interpolate_8 = Interpolate(Vertices=construct_point_8, Degree=3, Periodic=False, KnotStyle=1)  # -> Curve, Length, Domain
curve = Curve(interpolate_2.Curve)
curve_2 = Curve(interpolate_3.Curve)
curve_3 = Curve(interpolate.Curve)
interpolate_9 = Interpolate(Vertices=construct_point_9, Degree=3, Periodic=False, KnotStyle=1)  # -> Curve, Length, Domain
interpolate_10 = Interpolate(Vertices=construct_point_10, Degree=3, Periodic=False, KnotStyle=1)  # -> Curve, Length, Domain
interpolate_11 = Interpolate(Vertices=construct_point_12, Degree=3, Periodic=False, KnotStyle=1)  # -> flatten(Curve), Length, Domain
curve_4 = Curve(interpolate_4.Curve)
interpolate_12 = Interpolate(Vertices=construct_point_11, Degree=3, Periodic=False, KnotStyle=1)  # -> Curve, Length, Domain
curve_5 = Curve(interpolate_6.Curve)
curve_6 = Curve(interpolate_5.Curve)
curve_7 = Curve(interpolate_7.Curve)
interpolate_13 = Interpolate(Vertices=construct_point_13, Degree=3, Periodic=False, KnotStyle=1)  # -> Curve, Length, Domain
curve_8 = Curve(interpolate_8.Curve)
curve_9 = Curve(interpolate_9.Curve)
curve_10 = Curve(interpolate_10.Curve)
curve_11 = Curve(interpolate_12.Curve)
curve_12 = Curve(interpolate_11.Curve)
curve_13 = Curve(interpolate_13.Curve)
# circles
u_14 = Slider(2, range=0..10)
# translation
u_15 = Slider(2, range=0..10)
a_2 = Slider(1, range=0..10)
# scaling
u_16 = Slider(2, range=0..10)
r_2 = Slider(0.5, range=-2..2)
# cutting
u_17 = Slider(1, range=0..10)
# cylinder
u_18 = Slider(2, range=0..2)
v = Slider(0.5, range=0..2)
# sphere
u_19 = Slider(2, range=0..2)
v_2 = Slider(1, range=0..2)
b_2 = Slider(1, range=0..10)
pi_14 = Pi(Factor=u_16)
pi_15 = Pi(Factor=u_18)
pi_16 = Pi(Factor=v)
pi_17 = Pi(Factor=u_19)
pi_18 = Pi(Factor=v_2)
pi_19 = Pi(Factor=u_15)
pi_20 = Pi(Factor=u_14)
pi_21 = Pi(Factor=u_17)
range_14 = Range(Domain=pi_14, Steps="100")
range_15 = Range(Domain=pi_19, Steps="100")
range_16 = Range(Domain=pi_20, Steps="100")
range_17 = Range(Domain=pi_21, Steps="100")
range_18 = Range(Domain=pi_15, Steps="100")
range_19 = Range(Domain=pi_16, Steps="10")  # -> graft(Range)
range_20 = Range(Domain=pi_17, Steps="100")
range_21 = Range(Domain=pi_18, Steps="10")  # -> graft(Range)
sine_8 = Sine(Value=range_16)
cosine_2 = Cosine(Value=range_16)
sine_9 = Sine(Value=range_17)
cosine_3 = Cosine(Value=range_17)
cosine_4 = Cosine(Value=range_15)
sine_10 = Sine(Value=range_15)
sine_11 = Sine(Value=range_14)
cosine_5 = Cosine(Value=range_14)
cosine_6 = Cosine(Value=range_18)
sine_12 = Sine(Value=range_18)
cosine_7 = Cosine(Value=range_20)
sine_13 = Sine(Value=range_20)
sine_14 = Sine(Value=range_21)
cosine_8 = Cosine(Value=range_21)
construct_point_14 = ConstructPoint(XCoordinate=sine_8, YCoordinate=cosine_2, ZCoordinate=0)
construct_point_15 = ConstructPoint(XCoordinate=sine_9, YCoordinate=cosine_3, ZCoordinate=0)
x = Number(cosine_6)
y = Number(sine_12)
z = Number(range_19)
multiplication_5 = Multiplication(A=sine_11, B=r_2)
multiplication_6 = Multiplication(A=cosine_5, B=r_2)
addition_3 = Addition(A=sine_10, B=a_2)
addition_4 = Addition(A=cosine_4, B=b_2)
construct_point_16 = ConstructPoint(XCoordinate=x, YCoordinate=y, ZCoordinate=z)
multiplication_7 = Multiplication(A=cosine_7, B=sine_14)
multiplication_8 = Multiplication(A=sine_13, B=sine_14)
interpolate_14 = Interpolate(Vertices=construct_point_14, Degree=3, Periodic=False, KnotStyle=1)  # -> Curve, Length, Domain
interpolate_15 = Interpolate(Vertices=construct_point_15, Degree=3, Periodic=False, KnotStyle=1)  # -> Curve, Length, Domain
construct_point_17 = ConstructPoint(XCoordinate=multiplication_5, YCoordinate=multiplication_6, ZCoordinate=0)
construct_point_18 = ConstructPoint(XCoordinate=addition_3, YCoordinate=addition_4, ZCoordinate=0)
x_2 = Number(multiplication_7)
y_2 = Number(multiplication_8)
z_2 = Number(cosine_8)
interpolate_16 = Interpolate(Vertices=construct_point_16, Degree=3, Periodic=False, KnotStyle=1)  # -> Curve, Length, Domain
interpolate_17 = Interpolate(Vertices=construct_point_17, Degree=3, Periodic=False, KnotStyle=1)  # -> Curve, Length, Domain
curve_14 = Curve(interpolate_15.Curve)
curve_15 = Curve(interpolate_14.Curve)
interpolate_18 = Interpolate(Vertices=construct_point_18, Degree=3, Periodic=False, KnotStyle=1)  # -> Curve, Length, Domain
construct_point_19 = ConstructPoint(XCoordinate=x_2, YCoordinate=y_2, ZCoordinate=z_2)
curve_16 = Curve(interpolate_16.Curve)
curve_17 = Curve(interpolate_18.Curve)
curve_18 = Curve(interpolate_17.Curve)
interpolate_19 = Interpolate(Vertices=construct_point_19, Degree=3, Periodic=False, KnotStyle=1)  # -> Curve, Length, Domain
curve_19 = Curve(interpolate_19.Curve)
