# Grasshopper definition hello-python.gh (Grasshopper 1.0.7)
# Copyright: GNU General Public License 3.0
# plug-ins: Hops

# ---- group: hello world
# Hello Python
# cpython via hops
# python hello-python.py
# http://127.0.0.1:5000/hello
panel = Panel("World")
hops = Hops(
    Name=panel,
    CacheResultsInMemory=True,
    CacheSolveResults=True,
    RemoteDefinitionLocation="http://127.0.0.1:5000/hello",
    RemoteSolveVersion=(0, 1, 0),
    ShowInput_Enabled=False,
    ShowInput_Path=False,
    SynchronousSolve=True)
panel_2 = Panel(hops)

# ---- group: random integer
# numpy via hops
# python hello-numpy.py
# http://127.0.0.1:5000/randominteger
range = Slider(100, range=0..100)
hops_2 = Hops(
    Range=range,
    CacheResultsInMemory=True,
    CacheSolveResults=True,
    RemoteDefinitionLocation="http://127.0.0.1:5000/randominteger",
    RemoteSolveVersion=(0, 1, 0),
    ShowInput_Enabled=False,
    ShowInput_Path=False,
    SynchronousSolve=True)
panel_3 = Panel(hops_2)
