# Grasshopper definition machina-transform.gh (Grasshopper 1.0.7)
# plug-ins: Machina

# ---- group: create robot system
# using machina
panel = Panel("UR")
# system
panel_2 = Panel("transform")
# UR5e
createrobot = CreateRobot(Name=panel_2, Brand=panel)

# ---- group: set motion mode
# commands
motionmode = MotionMode(MotionMode=1)

# ---- group: set initial speed
speed = Slider(30, range=0..100)
speedto = SpeedTo(Speed=speed, Relative=False)

# ---- group: transformations
point = Point()
flip_plane = FlipPlane(Plane=point, ReverseX=False, ReverseY=False, SwapAxes=True)
transformto = TransformTo(Plane=flip_plane, Relative=False)

# ---- group: merge actions
merge = Merge(Data1=motionmode, Data2=speedto, Data3=transformto)

# ---- group: generate program
# program
boolean_toggle = BooleanToggle(True)
actions = Panel(merge)
compileprogram = CompileProgram(Robot=createrobot, Actions=merge, InLineTargets=boolean_toggle, Comments=Toggle(True))

# ---- group: save program
# output
c_script = CSharpScript()  # -> out, here
# ---------- c_script: C# usings ----------
using System.IO;
# ---------- c_script: C# ----------
    string targetFolder = "";

    GH_Document gh_d = owner.OnPingDocument();
    if (gh_d.IsFilePathDefined)
    {
      string ghFilePath = gh_d.FilePath;
      targetFolder = Path.GetDirectoryName(ghFilePath);
    }
    else
    {
      Print("No local folder found, please save your file locally.");
    }

    here = targetFolder;
# ---------- end c_script ----------
saveprogram = SaveProgram(Robot=createrobot, RobotProgram=compileprogram, Path=c_script.here)
panel_3 = Panel(saveprogram)

# ---- group: print program
displayprogram = DisplayProgram(RobotProgram=compileprogram)
panel_4 = Panel(displayprogram)
