# Grasshopper definition machina-ur10e-wandering-vector.gh (Grasshopper 1.0.7)
# plug-ins: Machina, Nursery

# ---- group: create robot system
# using machina
panel = Panel("UR")
# system
panel_2 = Panel("move_to_point")
# UR10e
# real-time control
# move to point
createrobot = CreateRobot(Name=panel_2, Brand=panel)

# ---- group: set speed
speed = Slider(50, range=0..100)
speedto = SpeedTo(Speed=speed, Relative=False)

# ---- group: starting message
# commands
panel_3 = Panel("move to point and return to home")
message = Message(Message=panel_3)

# ---- group: wait
time = Slider(1000, range=0..5000)
wait = Wait(Time=time)

# ---- group: particle wandering across noise field
# wandering vector
# using nursery
x = Slider(500, range=-1300..1300)
y = Slider(0, range=-1300..1300)
z = Slider(0, range=-1300..1300)
weight = Slider(2, range=0..10)
distance = Slider(1300, range=0..1300)
attenuation = Slider(0, range=0..1)
noise = Slider(0.02, range=0..1)
rotation = Slider(4.81, range=0..10)
resolution = Slider(20, range=0..100)
construct_point = ConstructPoint(XCoordinate=x, YCoordinate=y, ZCoordinate=z)
xy = XYPlane(Origin=construct_point)
createnoiseelement = CreateNoiseFieldElement(
    NoiseLocation=xy,
    Weight=weight,
    MaxDistance=distance,
    Attenuation=attenuation,
    NoiseScale=noise,
    RotationScale=rotation,
    XY=True)
createfield = CreateField(FieldElements=createnoiseelement)
steps = Slider(1000, range=0..1000)
xy_2 = XYPlane(Origin=xy)
simfield = SimulateField(Planes=xy_2, Field=createfield, SimulationSteps=steps, Strength=Slider(2, range=0..10), Normalize=False)
interpolate = Interpolate(Vertices=simfield, Degree=3, Periodic=False, KnotStyle=1)  # -> Curve, Length, Domain
divide_distance = DivideDistance(Curve=interpolate.Curve, Distance=resolution)  # -> Points, Tangents, Parameters
point = Point(divide_distance.Points)

# ---- group: move to point
# wandering vector points
point_2 = Point(point)
moveto = MoveTo(Point=point_2, Relative=False)  # -> flatten(Action)

# ---- group: set initial speed
speed_2 = Slider(36, range=0..100)
speedto_2 = SpeedTo(Speed=speed_2, Relative=False)

# ---- group: move home
# set home position
# using joint rotation angles
# in degrees
panel_4 = Panel("0")
axesto = AxesTo(A1=panel_4, A2="-90", A3="-90", A4="-90", A5="90", A6=panel_4, Relative=False)

# ---- group: merge actions
# program
merge = Merge(Data1=message, Data2=speedto_2, Data3=moveto, Data4=wait, Data5=speedto, Data6=axesto)
panel_5 = Panel(merge)

# ---- group: generate program
compileprogram = CompileProgram(Robot=createrobot, Actions=merge, InLineTargets=Toggle(True), Comments=Toggle(True))

# ---- group: save program
# output
# stream
c_script = CSharpScript()  # -> out, here
# ---------- c_script: C# usings ----------
using System.IO;
# ---------- c_script: C# ----------
    string targetFolder = "";

    GH_Document gh_d = owner.OnPingDocument();
    if (gh_d.IsFilePathDefined)
    {
      string ghFilePath = gh_d.FilePath;
      targetFolder = Path.GetDirectoryName(ghFilePath);
    }
    else
    {
      Print("No local folder found, please save your file locally.");
    }

    here = targetFolder;
# ---------- end c_script ----------
saveprogram = SaveProgram(Robot=createrobot, RobotProgram=compileprogram, Path=c_script.here)
panel_6 = Panel(saveprogram)

# ---- group: stream program via machina bridge
connect_to_bridge = BooleanToggle(False)
send_program = Button()
connect = Connect(URL="ws://127.0.0.1:6999/Bridge", Name="Grasshopper", Connect=connect_to_bridge)  # -> Status, Bridge
send = Send(Bridge=connect.Bridge, Actions=merge, Send=send_program)  # -> Sent, Instructions
listen = Listen(Bridge=connect.Bridge, Autoupdate=True, Interval=66)
panel_7 = Panel(connect.Status)
actionexecuted = ActionExecuted(BridgeMessage=listen)  # -> LastAction, ActionTCP, ActionAxes, ActionExternalAxes, PendingActions, PendingActionsOnDevice
panel_8 = Panel(send.Sent)
panel_9 = Panel(send.Instructions)
panel_10 = Panel(actionexecuted.PendingActions)
panel_11 = Panel(actionexecuted.LastAction)
data_recorder = DataRecorder(actionexecuted.ActionTCP, DataLimit=-10, RecordData=True)
plane = Plane(data_recorder)

# ---- group: print program
displayprogram = DisplayProgram(RobotProgram=compileprogram)
panel_12 = Panel(displayprogram)
