# Grasshopper definition ur10e.gh (Grasshopper 1.0.7)
# plug-ins: Robots

# ---- group: robot system
list = ValueList({"UR5e", "UR10e"}, selected="UR5e")
# UR10e
# program & simulation:
# home position
load_robot_system = LoadRobotSystem(Name=list, Base="0,0,240")

# ---- group: tool
create_tool = CreateTool(Name="DefaultGHTool", TCP=PlaneXY(0, 0, 0), Weight=0)  # -> Tool, TCP

# ---- group: home position
# A home position should be set using joint rotation values.
# This is the only way to unambiguously define a robot pose.
home_position = Panel("pi/2,-pi/2,pi/2,-pi/2,-pi/2,0")
speed_parameter = SpeedParameter("30.0")
zone_parameter = ZoneParameter("20.0")
create_target = CreateTarget(Joints=home_position, Tool=create_tool.Tool, Speed=speed_parameter, Zone=zone_parameter, IsCartesian=False)

# ---- group: program
create_program = CreateProgram(Name="program", RobotSystem=load_robot_system, Targets1=create_target, StepSize=1)  # -> Program, Code, Duration, Warnings, Errors

# ----
robot_program = Panel(create_program.Program)

# ---- group: preview
# Right click Program Simulation
# and select 'open controls'
# to preview the tool path
# or move the slider.
number_slider = Slider(0, range=0..1)
program_simulation = ProgramSimulation(Program=create_program.Program, Time=number_slider, Normalized=True)  # -> SystemMeshes, JointRotations, Plane, Index, Time, Program, Errors
simple_trail = SimpleTrail(Program=program_simulation.Program, Length=500, MechanicalGroup=0)
time = Panel(program_simulation.Time)

# ---- group: save program to file
# Enable to save the program to a file.
filepath = Panel("D:\generative-design\robotics\robots\scripts")
save_program = SaveProgram(Program=create_program.Program, Folder=filepath)  # disabled
