# Grasshopper definition ink-brush-tool.gh (Grasshopper 1.0.7)
# Copyright: GNU General Public License

# ---- group: tool mount
# ink brush tool
# tool mount
radius = Slider(37.5, range=0..100)
radius_2 = Slider(25, range=0..100)
radius_3 = Slider(3.2, range=0..10)
radius_4 = Slider(5.7, range=0..10)
pin = Slider(3, range=0..10)
thickness = Slider(10, range=0..10)
unit_z = UnitZ(Factor=thickness)
unit_x = UnitX(Factor=radius_2)
circle = Circle(Plane=PlaneXY(0, 0, 0), Radius=radius)
circle_2 = Circle(Plane=PlaneXY(0, 0, 0), Radius=pin)
circle_3 = Circle(Plane=PlaneXY(0, 0, 0), Radius=[radius_3, radius_4])
vector = Vector(unit_x)
extrude = Extrude(Base=circle, Direction=unit_z)
move = Move(Geometry=circle_3, Motion=unit_x)  # -> Geometry, Transform
move_2 = Move(Geometry=circle_2, Motion=vector)  # -> Geometry, Transform
polar_array = PolarArray(Geometry=move.Geometry, Plane=PlaneXY(0, 0, 0), Count="4", Angle=6.283185307)  # -> Geometry, Transform
rotate = Rotate(Geometry=move_2.Geometry, Angle=degrees("45"), Plane=PlaneXY(0, 0, 0))  # -> Geometry, Transform
vector_2 = Vector(unit_z)
vector_3 = Vector(vector_2)
vector_4 = Vector(vector_2)
extrude_2 = Extrude(Base=rotate.Geometry, Direction=vector_3)
explode_tree = ExplodeTree(Data=polar_array.Geometry)  # -> Branch0, Branch1
division = Division(A=vector_4, B="2")
extrude_3 = Extrude(Base=explode_tree.Branch0, Direction=vector_2)
extrude_4 = Extrude(Base=explode_tree.Branch1, Direction=division)
cap_holes = CapHoles(Brep=extrude)
cap_holes_2 = CapHoles(Brep=extrude_3)
cap_holes_3 = CapHoles(Brep=extrude_4)
cap_holes_4 = CapHoles(Brep=extrude_2)
solid_difference = SolidDifference(BrepsA=cap_holes, BrepsB=flatten([cap_holes_2, cap_holes_3, cap_holes_4]))
fillet_edge = FilletEdge(Shape=solid_difference, Blend=1, Metric=0, Edges="2", Radii="0.5")

# ---- group: magnet
magnet_radius = Slider(16, range=0..30)
magnet_depth = Slider(3, range=0..10)
unit_z_2 = UnitZ(Factor=magnet_depth)
circle_4 = Circle(Plane=PlaneXY(0, 0, 0), Radius=magnet_radius)
extrude_5 = Extrude(Base=circle_4, Direction=unit_z_2)
cap_holes_5 = CapHoles(Brep=extrude_5)

# ---- group: brush stem
# brush
radius_5 = Slider(5, range=0..100)
stem = Slider(195, range=0..1000)
circle_5 = Circle(Plane=PlaneXY(0, 0, 0), Radius=radius_5)
negative = Negative(Value=stem)
unit_z_3 = UnitZ(Factor=negative)
extrude_6 = Extrude(Base=circle_5, Direction=unit_z_3)
cap_holes_6 = CapHoles(Brep=extrude_6)
custom_preview = CustomPreview(Geometry=cap_holes_6, Material=ColourSwatch(SwatchColor=RGB(128, 85, 64)))
brush_stem = Brep(cap_holes_6)

# ----
# brush holder
magnet = Brep(cap_holes_5)
plate_base = Circle(circle)
length = Slider(5, range=0..25)
radius_6 = Slider(10, range=0..100)
length_2 = Slider(30, range=0..100)
brush_base = Circle(circle_5)
scale = Slider(1.05, range=1..1.2)
gap = Slider(0.5, range=0..2)
radius_7 = Slider(3, range=0..10)
width = Slider(5, range=0..10)
scale_2 = Scale(Geometry=brush_base, Center=Point(0, 0, 0), Factor=scale)  # -> Geometry, Transform
negative_2 = Negative(Value=length)
circle_6 = Circle(Plane=PlaneXY(0, 0, 0), Radius=radius_6)
negative_3 = Negative(Value=length_2)
unit_z_4 = UnitZ(Factor=negative_2)
unit_z_5 = UnitZ(Factor=negative_3)
extrude_7 = Extrude(Base=plate_base, Direction=unit_z_4)
extrude_8 = Extrude(Base=circle_6, Direction=unit_z_5)
extrude_9 = Extrude(Base=scale_2.Geometry, Direction=unit_z_5)
cap_holes_7 = CapHoles(Brep=extrude_7)
cap_holes_8 = CapHoles(Brep=extrude_8)
cap_holes_9 = CapHoles(Brep=extrude_9)
solid_difference_2 = SolidDifference(BrepsA=cap_holes_8, BrepsB=cap_holes_9)
fillet_edge_2 = FilletEdge(Shape=cap_holes_7, Blend=1, Metric=0, Edges="1", Radii="0.5")
magnet_2 = Brep(magnet)
vector_5 = Vector(unit_z_2)
negative_4 = Negative(Value=vector_5)
vector_6 = Vector(unit_z_4)
move_3 = Move(Geometry=solid_difference_2, Motion=vector_6)  # -> Geometry, Transform
move_4 = Move(Geometry=magnet_2, Motion=negative_4)  # -> Geometry, Transform
edges_from_linearity = EdgesFromLinearity(Brep=move_3.Geometry, Minimum=0, Maximum=1)  # -> Edges, Indices
fillet_edge_3 = FilletEdge(Shape=move_3.Geometry, Blend=1, Metric=0, Edges="1", Radii="0.5")
solid_difference_3 = SolidDifference(BrepsA=fillet_edge_2, BrepsB=move_4.Geometry)
negative_5 = Negative(Value=gap)
split_list = SplitList(List=edges_from_linearity.Edges, Index="1")  # -> ListA, ListB
unit_y = UnitY(Factor=gap)
unit_y_2 = UnitY(Factor=negative_5)
end_points = EndPoints(Curve=split_list.ListA)  # -> Start, End
end_points_2 = EndPoints(Curve=split_list.ListB)  # -> Start, End
move_5 = Move(Geometry=end_points.Start, Motion=unit_y)  # -> Geometry, Transform
move_6 = Move(Geometry=end_points_2.End, Motion=unit_y_2)  # -> Geometry, Transform
xz_plane = XZPlane(Origin=end_points.End)
circle_7 = Circle(Plane=xz_plane, Radius=radius_7)
unit_z_6 = UnitZ(Factor=radius_7)
box_2pt = Box2Pt(PointA=move_5.Geometry, PointB=move_6.Geometry, Plane=PlaneXY(0, 0, 0))
move_7 = Move(Geometry=circle_7, Motion=unit_z_6)  # -> Geometry, Transform
unit_y_3 = UnitY(Factor=width)
box_properties = BoxProperties(Box=box_2pt)  # -> Center, Diagonal, Area, Volume, Degeneracy
extrude_10 = Extrude(Base=move_7.Geometry, Direction=unit_y_3)
division_2 = Division(A=unit_y_3, B="-2")
scale_nu = ScaleNU(Geometry=box_2pt, Plane=box_properties.Center, ScaleX="3", ScaleY=1, ScaleZ=1)  # -> Geometry, Transform
scale_nu_2 = ScaleNU(Geometry=box_2pt, Plane=box_properties.Center, ScaleX="3", ScaleY="50", ScaleZ="0.5")  # -> Geometry, Transform
move_8 = Move(Geometry=extrude_10, Motion=division_2)  # -> Geometry, Transform
move_9 = Move(Geometry=scale_nu.Geometry, Motion="0,0,-10")  # -> Geometry, Transform
cap_holes_10 = CapHoles(Brep=move_8.Geometry)
box_properties_2 = BoxProperties(Box=cap_holes_10)  # -> Center, Diagonal, Area, Volume, Degeneracy
solid_difference_4 = SolidDifference(BrepsA=fillet_edge_3, BrepsB=move_9.Geometry)
scale_nu_3 = ScaleNU(Geometry=cap_holes_10, Plane=box_properties_2.Center, ScaleX="0.5", ScaleY=1, ScaleZ="0.5")  # -> Geometry, Transform
radius_8 = Number(radius_7)
solid_difference_5 = SolidDifference(BrepsA=solid_difference_4, BrepsB=scale_nu_2.Geometry)
division_3 = Division(A=radius_8, B="3")
plate = Brep(solid_difference_3)
subtraction = Subtraction(A=radius_8, B=division_3)
solid_difference_6 = SolidDifference(BrepsA=cap_holes_10, BrepsB=[scale_nu_3.Geometry, move_9.Geometry])
solid_union = SolidUnion(Breps=flatten([plate, solid_difference_5]))
unit_x_2 = UnitX(Factor=subtraction)
fillet_edge_4 = FilletEdge(Shape=solid_union, Blend=0, Metric=0, Edges="1", Radii="2")
move_10 = Move(Geometry=solid_difference_6, Motion=unit_x_2)  # -> Geometry, Transform
fastener = Brep(move_10.Geometry)
holder = Brep(fillet_edge_4)
solid_union_2 = SolidUnion(Breps=flatten([holder, fastener]))
custom_preview_2 = CustomPreview(Geometry=solid_union_2, Material=ColourSwatch(SwatchColor=RGB(209, 209, 209)))
holder_2 = Brep(solid_union_2)

vector_7 = Vector(unit_z_3)
magnet_3 = Brep(cap_holes_5)

# ---- group: tool mount
solid_union_3 = SolidUnion(Breps=fillet_edge)
solid_difference_7 = SolidDifference(BrepsA=solid_union_3, BrepsB=magnet_3)
custom_preview_3 = CustomPreview(Geometry=solid_difference_7, Material=ColourSwatch(SwatchColor=RGB(209, 209, 209)))
mount = Brep(solid_difference_7)

# ---- group: brush tip
brush = Slider(32, range=0..100)
circle_8 = Circle(circle_5)
radius_9 = Number(radius_5)
unit_z_7 = UnitZ(Factor=brush)
cone = Cone(Base=circle_8, Radius=radius_9, Length=unit_z_7)  # -> Cone, Tip
xz_plane_2 = XZPlane(Origin=Point(0, 0, 0))
rotate_2 = Rotate(Geometry=cone.Cone, Angle=degrees("180"), Plane=xz_plane_2)  # -> Geometry, Transform

# ----
move_11 = Move(Geometry=rotate_2.Geometry, Motion=vector_7)  # -> Geometry, Transform

# ---- group: brush tip (continued)
custom_preview_4 = CustomPreview(Geometry=move_11.Geometry, Material=ColourSwatch(SwatchColor=RGB(255, 170, 128)))
brush_tip = Brep(move_11.Geometry)
