# Grasshopper definition robotic-planter.gh (Grasshopper 1.0.7)
# Copyright: GNU General Public License

# ---- group: Top
# robotic planter
# planter
radius = Slider(50, range=0..100)
fillet = Slider(5, range=0..25)
thickness = Slider(36, range=0..100)
rim_width = Slider(25, range=0..100)
thickness_2 = Slider(5, range=0..10)
polygon = Polygon(Plane=PlaneXY(0, 0, 0), Radius=radius, Segments="6", FilletRadius=fillet)  # -> Polygon, Length
unit_z = UnitZ(Factor=thickness)
move = Move(Geometry=polygon.Polygon, Motion=unit_z)  # -> Geometry, Transform
extrude = Extrude(Base=polygon.Polygon, Direction=unit_z)
offset_curve = OffsetCurve(Curve=move.Geometry, Distance=rim_width, Plane=PlaneXY(0, 0, 0), Corners=1)
boundary_surfaces = BoundarySurfaces(Edges=flatten([move.Geometry, offset_curve]))
unit_z_2 = UnitZ(Factor=thickness_2)
extrude_2 = Extrude(Base=boundary_surfaces, Direction=unit_z_2)
walls = Brep(extrude)
ring = Brep(extrude_2)

# ---- group: Base
polygon_2 = Curve(polygon.Polygon)
tip = Slider(36, range=0..100)
negative = Negative(Value=tip)
construct_point = ConstructPoint(XCoordinate=0, YCoordinate=0, ZCoordinate=negative)
extrude_point = ExtrudePoint(Base=polygon_2, Point=construct_point)
base = Brep(extrude_point)

# ---- group: Volume
scale = Slider(1.2, range=0..2)
ring_2 = Brep(extrude_2)
base_2 = Brep(base)
walls_2 = Brep(walls)
vector = Vector(unit_z)
brep_join = BrepJoin(Breps=[base_2, walls_2])  # -> Breps, Closed
move_2 = Move(Geometry="0,0,0", Motion=vector)  # -> Geometry, Transform
cap_holes = CapHoles(Brep=brep_join.Breps)
scale_2 = Scale(Geometry=cap_holes, Center=move_2.Geometry, Factor=scale)  # -> Geometry, Transform
solid_difference = SolidDifference(BrepsA=scale_2.Geometry, BrepsB=cap_holes)
base_3 = Brep(solid_difference)
ring_3 = Brep(ring_2)
solid_union = SolidUnion(Breps=[base_3, ring_3])
panel = Panel("""37
40
42""")
fillet_edge = FilletEdge(Shape=solid_union, Blend=0, Metric=0, Edges=panel, Radii="2")
planter = Brep(fillet_edge)

# ---- group: Frame
# carriage
curve = Curve(offset_curve)
height = Slider(150, range=0..250)
discontinuity = Discontinuity(Curve=curve, Level=2)  # -> Points, Parameters
panel_2 = Panel("""0
0
0
0
1
1""")
shift_list = ShiftList(List=discontinuity.Points, Shift="4", Wrap=True)
dispatch = Dispatch(List=shift_list, DispatchPattern=panel_2)  # -> ListA, ListB
panel_3 = Panel("""1
0
1
0""")
dispatch_2 = Dispatch(List=dispatch.ListA, DispatchPattern=panel_3)  # -> ListA, ListB
unit_z_3 = UnitZ(Factor=height)
line = Line(StartPoint=dispatch_2.ListA, EndPoint=dispatch_2.ListB)
move_3 = Move(Geometry=line, Motion=unit_z_3)  # -> Geometry, Transform
extrude_3 = Extrude(Base=line, Direction=unit_z_3)
split_list = SplitList(List=move_3.Geometry, Index="1")  # -> ListA, ListB
end_points = EndPoints(Curve=split_list.ListA)  # -> Start, End
end_points_2 = EndPoints(Curve=split_list.ListB)  # -> Start, End
_4point_surface = _4PointSurface(CornerA=end_points.Start, CornerB=end_points.End, CornerC=end_points_2.Start, CornerD=end_points_2.End)
frame_top = Brep(_4point_surface)

# ---- group: Handles
line_2 = Line(line)
holder_y = Slider(14, range=0..100)
thickness_3 = Number(thickness_2)
addition = Addition(A=holder_y, B=thickness_3)
unit_y = UnitY(Factor=addition)
negative_2 = Negative(Value=thickness_3)
negative_3 = Negative(Value=unit_y)
extrude_4 = Extrude(Base=line_2, Direction=[unit_y, negative_3])
unit_y_2 = UnitY(Factor=[negative_2, thickness_3])
unit_z_4 = UnitZ(Factor=negative_2)
move_4 = Move(Geometry=extrude_4, Motion=unit_y_2)  # -> Geometry, Transform
extrude_5 = Extrude(Base=move_4.Geometry, Direction=unit_z_4)
handles = Brep(extrude_5)

# ---- group: Slots
handle_top_face = Surface(move_4.Geometry)
radius_2 = Slider(2, range=0..10)
polygon_center = PolygonCenter(Polyline=handle_top_face)  # -> CenterV, CenterE, CenterA
sphere = Sphere(Base=polygon_center.CenterV, Radius=radius_2)
sphere_2 = Brep(sphere)

# ---- group: Volume
frame_sides = Brep(extrude_3)
thickness_4 = Number(thickness_2)
handles_2 = Brep(handles)
sphere_3 = Brep(sphere)
frame_top_2 = Brep(_4point_surface)
unit_y_3 = UnitY(Factor=thickness_4)
unit_z_5 = UnitZ(Factor=thickness_4)
negative_4 = Negative(Value=unit_y_3)
negative_5 = Negative(Value=unit_z_5)
extrude_6 = Extrude(Base=frame_sides, Direction=[negative_4, unit_y_3])
extrude_7 = Extrude(Base=frame_top_2, Direction=negative_5)
solid_union_2 = SolidUnion(Breps=flatten([extrude_6, extrude_7, handles_2]))
panel_4 = Panel("""13
19
23
27
35
41
45
49""")
fillet_edge_2 = FilletEdge(Shape=solid_union_2, Blend=0, Metric=0, Edges=panel_4, Radii="2")
solid_union_3 = SolidUnion(Breps=flatten([fillet_edge_2, sphere_3]))
carriage = Brep(solid_union_3)

# ---- group: Tie
frame_top_3 = Brep(frame_top)
radius_3 = Slider(8, range=0..10)
thickness_5 = Number(thickness_2)
pipe_radius = Slider(2, range=0..10)
polygon_center_2 = PolygonCenter(Polyline=frame_top_3)  # -> CenterV, CenterE, CenterA
negative_6 = Negative(Value=thickness_5)
unit_z_6 = UnitZ(Factor=negative_6)
circle = Circle(Plane=polygon_center_2.CenterA, Radius=radius_3)
extrude_8 = Extrude(Base=circle, Direction=unit_z_6)
divide_curve = DivideCurve(Curve=circle, Count="2", Kinks=False)  # -> Points, Tangents, Parameters
division = Division(A=unit_z_6, B="2")
cap_holes_2 = CapHoles(Brep=extrude_8)
move_5 = Move(Geometry=divide_curve.Points, Motion=division)  # -> Geometry, Transform
polyline = PolyLine(Vertices=move_5.Geometry, Closed=False)
pipe = Pipe(Curve=polyline, Radius=pipe_radius, Caps=0)
hole = Brep(cap_holes_2)
pipe_2 = Brep(pipe)

# ---- group: slots
sphere_4 = Brep(sphere_2)
solid_difference_2 = SolidDifference(BrepsA=planter, BrepsB=sphere_4)
planter_2 = Brep(solid_difference_2)

# ----
hole_2 = Brep(hole)
pipe_3 = Brep(pipe_2)
solid_difference_3 = SolidDifference(BrepsA=carriage, BrepsB=hole_2)
solid_union_4 = SolidUnion(Breps=flatten([pipe_3, solid_difference_3]))
carriage_2 = Brep(solid_union_4)

frame_sides_2 = Brep(extrude_3)

# ---- group: render
carriage_3 = Brep(carriage_2)
custom_preview = CustomPreview(Geometry=carriage_3, Material=ColourSwatch(SwatchColor=RGB(82, 82, 82)))

planter_3 = Brep(planter_2)
custom_preview_2 = CustomPreview(Geometry=planter_3, Material=ColourSwatch(SwatchColor=RGB(204, 204, 204)))
