# Grasshopper definition tool-mount.gh (Grasshopper 1.0.7)
# Copyright: GNU General Public License

# ---- group: tool mount
# tool mount
# ur10e
radius = Slider(37.5, range=0..100)
thickness = Slider(10, range=0..10)
radius_2 = Slider(25, range=0..100)
radius_3 = Slider(3.2, range=0..10)
radius_4 = Slider(5.7, range=0..10)
pin = Slider(3, range=0..10)
unit_z = UnitZ(Factor=thickness)
unit_x = UnitX(Factor=radius_2)
circle = Circle(Plane=PlaneXY(0, 0, 0), Radius=radius)
circle_2 = Circle(Plane=PlaneXY(0, 0, 0), Radius=pin)
circle_3 = Circle(Plane=PlaneXY(0, 0, 0), Radius=[radius_3, radius_4])
vector = Vector(unit_x)
extrude = Extrude(Base=circle, Direction=unit_z)
move = Move(Geometry=circle_3, Motion=unit_x)  # -> Geometry, Transform
move_2 = Move(Geometry=circle_2, Motion=vector)  # -> Geometry, Transform
polar_array = PolarArray(Geometry=move.Geometry, Plane=PlaneXY(0, 0, 0), Count="4", Angle=6.283185307)  # -> Geometry, Transform
rotate = Rotate(Geometry=move_2.Geometry, Angle=degrees("45"), Plane=PlaneXY(0, 0, 0))  # -> Geometry, Transform
vector_2 = Vector(unit_z)
vector_3 = Vector(vector_2)
vector_4 = Vector(vector_2)
extrude_2 = Extrude(Base=rotate.Geometry, Direction=vector_3)
explode_tree = ExplodeTree(Data=polar_array.Geometry)  # -> Branch0, Branch1
division = Division(A=vector_4, B="2")
extrude_3 = Extrude(Base=explode_tree.Branch0, Direction=vector_2)
extrude_4 = Extrude(Base=explode_tree.Branch1, Direction=division)
cap_holes = CapHoles(Brep=extrude)
cap_holes_2 = CapHoles(Brep=extrude_3)
cap_holes_3 = CapHoles(Brep=extrude_4)
cap_holes_4 = CapHoles(Brep=extrude_2)
solid_difference = SolidDifference(BrepsA=cap_holes, BrepsB=flatten([cap_holes_2, cap_holes_3, cap_holes_4]))
fillet_edge = FilletEdge(Shape=solid_difference, Blend=1, Metric=0, Edges="2", Radii="0.5")
custom_preview = CustomPreview(Geometry=fillet_edge, Material=ColourSwatch(SwatchColor=RGB(209, 209, 209)))
